# Dynamo graph 2.0.3-List_Compare-0.1.2.dyn (Dynamo 2.5.0.7460)

# group: Assumed This Is Data Gathering Section
# note: ....

# group: Original
# note: ....

# group: List of Apartments from Model (Number, Content and Type)
required_rooms = CodeBlock()
# ---------- required_rooms.designscript (9 lines) ----------
[
["Bedroom", "Bedroom", "Bedroom", "Kitchen", "Bathroom", "En-Suite", "Living Room","Store"],
["Bedroom", "Bedroom", "Bedroom", "Kitchen", "Bathroom", "En-Suite", "Living Room","Store"],
["Bedroom", "Bedroom", "Bedroom", "Kitchen", "Bathroom", "En-Suite", "Living Room","Store"],
["Bedroom", "Bedroom", "Bedroom", "Kitchen", "Bathroom", "En-Suite", "Living Room","Store","Dining"],
["Bedroom", "Bedroom", "Bedroom", "Kitchen", "Bathroom", "En-Suite", "Living Room"],
["Bedroom", "Bedroom", "Bedroom", "Kitchen", "Bathroom", "En-Suite", "Living Room","Store"],
["Bedroom", "Bedroom", "Kitchen", "Bathroom", "En-Suite", "Living Room","Store"]
];
# ----------------------------------------
shuffle = List.Shuffle(list=required_rooms@L2)
apartment_number = CodeBlock { ["001","012","034","065","075","076","077"]; }
apartment_type = CodeBlock { ["Apt_01","Apt_01","Apt_01","Apt_01","Apt_01","Apt_01","Apt_02"]; }

# group: Get full list of unique items for comparison and total count
code_block = CodeBlock { 1; }
flatten = List.Flatten(list=shuffle)
uniqueItems = List.UniqueItems(list=flatten)
count = List.Count(list=uniqueItems)

code_block_2 = CodeBlock { "Matching"; }

# group: Apartment Required content and corresponding Types
# note: Input lists to be compared would be drawn from the Revit model.  Lists to be compared against would be from Excel.  Apartment Type would be used as a the Key to link both lists.
apartment_numbers_defined = CodeBlock { ["Apt_01","Apt_02"]; }
required_rooms_2 = CodeBlock()
# ---------- required_rooms_2.designscript (4 lines) ----------
[
["Bedroom", "Bedroom", "Bedroom", "Kitchen", "Bathroom", "En-Suite", "Living Room","Store"],
["Bedroom", "Bedroom", "Kitchen", "Bathroom", "En-Suite", "Living Room","Store"]
];
# ----------------------------------------

# group: Create dictionary and generate list based on apartment type
byKeysValues = DesignScript.Builtin.Dictionary.ByKeysValues(keys=apartment_numbers_defined, values=required_rooms_2)
valueAtKey = DesignScript.Builtin.Dictionary.ValueAtKey(dictionary=byKeysValues, key=apartment_type)

# group: Count number of unique items in base list
countOccurrences = String.CountOccurrences(str=valueAtKey@L2, searchFor=uniqueItems, lacing=CrossProduct)
sum = Math.Sum(values=countOccurrences)

# group: Count number of unique items in each list
countOccurrences_2 = String.CountOccurrences(str=shuffle, searchFor=uniqueItems, lacing=CrossProduct)
sum_2 = Math.Sum(values=countOccurrences_2, lacing=Longest)

# group: Calculate differences in room numbers
sub = sum_2 - sum

# group: Missing Rooms
code_block_3 = CodeBlock { 0; }
lt = sub < code_block_3
watch = Watch(sub)
# note: +ve numbers indicate rooms that are addtional - this section grabs those values from our unique list of rooms and duplicates them the required number of times.
code_block_4 = CodeBlock { 0; }
if_ = If(test=lt, true=watch, false=code_block_4)
code_block_5 = CodeBlock { "Missing"; }
mul = if_ * if_
sqrt = Math.Sqrt(number=mul)
transpose = List.Transpose(lists=sqrt)
ofRepeatedItem = List.OfRepeatedItem(item=uniqueItems, amount=transpose, lacing=Longest)

# group: Matching Rooms
watch_2 = Watch(sum)
add = watch_2 + if_
transpose_2 = List.Transpose(lists=add)
ofRepeatedItem_2 = List.OfRepeatedItem(item=uniqueItems, amount=transpose_2, lacing=Longest)
transpose_3 = List.Transpose(lists=ofRepeatedItem_2)
flatten_2 = List.Flatten(list=transpose_3, lacing=Longest)

addItemToFront = List.AddItemToFront(item=code_block_2, list=flatten_2@L2)

# group (continued): Matching Rooms
matching_rooms = Watch(addItemToFront)

# group: Additional Rooms
code_block_6 = CodeBlock { "Additional"; }
code_block_7 = CodeBlock { 0; }
gt = sub > code_block_7
watch_3 = Watch(sub)
# note: +ve numbers indicate rooms that are addtional - this section grabs those values from our unique list of rooms and duplicates them the required number of times.
code_block_8 = CodeBlock { 0; }
if_2 = If(test=gt, true=watch_3, false=code_block_8)
transpose_4 = List.Transpose(lists=if_2)
ofRepeatedItem_3 = List.OfRepeatedItem(item=uniqueItems, amount=transpose_4, lacing=Longest)
transpose_5 = List.Transpose(lists=ofRepeatedItem_3)

flatten_3 = List.Flatten(list=transpose_5, lacing=Longest)

# group (continued): Additional Rooms
addItemToFront_2 = List.AddItemToFront(item=code_block_6, list=flatten_3@L2)
addtional_rooms = Watch(addItemToFront_2)

transpose_6 = List.Transpose(lists=ofRepeatedItem)
flatten_4 = List.Flatten(list=transpose_6, lacing=Longest)

# group (continued): Missing Rooms
addItemToFront_3 = List.AddItemToFront(item=code_block_5, list=flatten_4@L2)
missing_rooms = Watch(addItemToFront_3)

# group: Collate and Export Data
file_path = Filename(".\List Compare.xlsx")
code_block_9 = CodeBlock { "Sheet02"; }
code_block_10 = CodeBlock { 1; }
exportExcel = Data.ExportExcel(filePath=file_path, sheetName=code_block_9, startRow=code_block_10, startCol=code_block_10)  # unwired: data
code_block_11 = CodeBlock { 1; }
chop = List.Chop(list=apartment_number, lengths=code_block_11)
list_create = List.Create(item0=chop, item1=matching_rooms, item2=addtional_rooms, item3=missing_rooms)
transpose_7 = List.Transpose(lists=list_create)
code_block_12 = CodeBlock { 1; }
flatten_5 = List.Flatten(list=transpose_7, amt=code_block_12)

watch_4 = Watch(required_rooms_2)

# group: Simpliar way to get same data output
maybe_a_better_end_arrangement = Python(IN[0]=shuffle, IN[1]=valueAtKey, IN[2]=apartment_number)  # "Maybe a better end arrangement(export into excel)?"
# ---------- maybe_a_better_end_arrangement.python (40 lines) ----------
# Created By Brendan Cassidy

# Ouput List and Excel Column Titles
output=[["Appartment No.", "Room Type","Matching", "Missing", "Additional"]]

#Counter for appartment name/number
count = 0

# Yes and No strings to be places in correct place
yes = "Y"
no= "N"

# Joints two inputs into a list then transposes them then we go over each one
for appartments,apTypes in zip(*[IN[0],IN[1]]):
	# Iterates over rooms in appartment
	for a in appartments:
		
		# Checks if room is in appartment set type list that it should match
		# if it matches it removes it and adds a yes under match column
		# If its not in then it adds a yes under additional
		if a in apTypes:
			apTypes.remove(a)
			output.append([IN[2][count], a, yes, no, no])
		else:
			output.append([IN[2][count], a, no, no, yes])


	# Checks if any items from apTypes wasnt removed
	# If any wasnt then it indicates missing items
	# So adds a yes under Missing	
	apTypeLen= len(apTypes)
	if apTypeLen > 0:
		for a in apTypes:
			output.append([IN[2][count], a, no, yes, no])
	
	# Counts count up one ready for next list index
	count = count + 1 
	
#standard output and transposed output
OUT=output, zip(*output)
# ----------------------------------------
code_block_13 = CodeBlock(a=maybe_a_better_end_arrangement)
# ---------- code_block_13.designscript (6 lines) ----------
//Not Transposed List
a[0];


//Transposed List
a[1];
# ----------------------------------------
transposed_list = Watch(code_block_13.out1)
not_transposed_list = Watch(code_block_13.out0)

# group: Using Python To create same output
how_to_do_all_in_python = Python(IN[0]=shuffle, IN[1]=valueAtKey, IN[2]=apartment_number)
# ---------- how_to_do_all_in_python.python (48 lines) ----------
# Created By Brendan Cassidy

# Ouput List
output=[]

#Counter for appartment name/number
count = 0

# Joints two inputs into a list then transposes them then we go over each one
for appartments,apTypes in zip(*[IN[0],IN[1]]):
	
	# Creates needed lists with associated titles
	missingItems = ["Missing"]
	additionalitems=["Additional"]
	matchingItems = ["Matching"]
	
	# Iterates over rooms in appartment
	for a in appartments:
		
		#Checks if room is in appartment set type list that it should match
		# if it matches it removes it and adds it to matching items list
		# If its not in then it adds it to additional items list
		if a in apTypes:
			apTypes.remove(a)
			matchingItems.append(a)
			
		else:
			additionalitems.append(a)
	
	# Checks if any items from apTypes wasnt removed
	# If any wasnt then it indicates missing items
	# So adds to a list for output	
	apTypeLen= len(apTypes)
	if apTypeLen > 0:
		missingItems = missingItems + apTypes
	
	#Adds all the items from above into output
	output.append([IN[2][count]])
	output.append(matchingItems)	
	output.append(missingItems)	
	output.append(additionalitems)
	
	# Counts count up one ready for next list index
	count = count + 1 


# Output
OUT=output
# ----------------------------------------
watch_5 = Watch(how_to_do_all_in_python)

# group: Way to create a unique list in python
unique_items = Python(IN[0]=shuffle)
# ---------- unique_items.python (15 lines) ----------
# Created By Brendan Cassidy


#Creates a list to append unique items into
uniqueList=[]


# How to get a Unique list of items from a list of list
for sublist in IN[0]:
	for a in sublist:
		if a not in uniqueList:
			uniqueList.append(a)

#outpout
OUT=uniqueList
# ----------------------------------------
watch_6 = Watch(unique_items)
