# Dynamo graph Archive Old Versions.dyn (Dynamo 2.0.3.8810)

directory_path = Directory("C:\temp\New folder")  # graph input
file_format = StringInput(".pdf")  # graph input
gets_only_pdf_files = Python(IN[0]=directory_path, IN[1]=file_format)
# ---------- gets_only_pdf_files.python (31 lines) ----------
#Created By Brendan Cassidy

import clr

#Sets up new path to ironpython module Library
import sys
sys.path.append("C:\Program Files (x86)\IronPython 2.7\Lib")

#Imports operating system interfaces
import os

import math


#Import directory
import_path=IN[0]

#File format type
file_format=IN[1]

#Get file path for any files that match
fileoutput=[]
for path, subdirs, files in os.walk(import_path):
	for fn in files:
		path_join=os.path.join(path, fn)
		file_name=os.path.basename(path_join)
		if file_format in file_name:
			fileoutput.append([path_join,file_name.Replace(IN[1],"")])

#Output        
OUT = fileoutput
# ----------------------------------------
transpose = List.Transpose(lists=gets_only_pdf_files)
code_block = CodeBlock(a=transpose)
# ---------- code_block.designscript (8 lines) ----------
//path

a[0];


//filename

a[1];
# ----------------------------------------
code_block_2 = CodeBlock(originalPaths=code_block.out0) { originalPaths; }
code_block_3 = CodeBlock(originalPaths=code_block_2) { originalPaths; }
watch = Watch(code_block.out1)
string = StringInput("_")
split_file_name = Python(IN[0]=watch, IN[1]=string)
# ---------- split_file_name.python (9 lines) ----------
# Created By Brendan Cassidy

output=[]
splitstring=IN[1]

for a in IN[0]:
	revtext=a.split(splitstring)[-1]
	output.append([a.replace((splitstring+revtext),""),revtext])
OUT=output
# ----------------------------------------
transpose_2 = List.Transpose(lists=split_file_name)
code_block_4 = CodeBlock(a=transpose_2) { a[0]; a[1]; }
list_create = List.Create(item0=code_block.out0, item1=code_block_4.out0, item2=code_block_4.out1)
transpose_3 = List.Transpose(lists=list_create)
code_block_5 = CodeBlock(a=list_create) { a[1]; }
groupByKey = List.GroupByKey(list=transpose_3, keys=code_block_5)
watch_2 = Watch(groupByKey.groups)
lastItem = List.LastItem(list=watch_2@@L3)
transpose_4 = List.Transpose(lists=lastItem)
code_block_6 = CodeBlock(a=transpose_4) { a[0]; }
outputs_archivable_files = Python(IN[0]=code_block_3, IN[1]=code_block_6)
# ---------- outputs_archivable_files.python (8 lines) ----------
# Create By Brendan Cassidy

output=[]

for a in IN[0]:
	if a not in IN[1]:
		output.append(a)
OUT=output
# ----------------------------------------
archive_folder_name = StringInput("Archive")
adds_archive_folder_to_end = Python(IN[0]=outputs_archivable_files, IN[1]=archive_folder_name)
# ---------- adds_archive_folder_to_end.python (19 lines) ----------
#Created By Brendan Cassidy

import clr

#Sets up new path to ironpython module Library
import sys
sys.path.append("C:\Program Files (x86)\IronPython 2.7\Lib")

#Imports operating system interfaces
import os
output=[]

for a in IN[0]:
	split=a.split("\\")[-1]
	output.append(a.replace(split,IN[1]+"\\" + split))


#Output        
OUT = output
# ----------------------------------------
list_create_2 = List.Create(item0=outputs_archivable_files, item1=adds_archive_folder_to_end)
transpose_5 = List.Transpose(lists=list_create_2)
moves_files = Python(IN[0]=transpose_5)
# ---------- moves_files.python (18 lines) ----------
#Created By Brendan Cassidy

import clr

#Sets up new path to ironpython module Library
import sys
sys.path.append("C:\Program Files (x86)\IronPython 2.7\Lib")

#Imports operating system interfaces
import shutil

for a in IN[0]:
	shutil.move(a[0],a[1])


	
#Output        
OUT = "complete"
# ----------------------------------------
