# Dynamo graph File Pattern Checker.dyn (Dynamo 2.0.3.8810)

# group: Input
# note: Directory path where files are stored
directory_path = Directory("C:\FilePatternChecker")  # graph input
# note: Regular Expression Checker
stringInput = StringInput(".\d{4}.rfa")  # graph input

# group: File Checker
get_file_paths_and_name = Python(IN[0]=directory_path)
# ---------- get_file_paths_and_name.python (22 lines) ----------
#Created By Brendan Cassidy

import clr

#Sets up new path to ironpython module Library
import sys
sys.path.append("C:\Program Files (x86)\IronPython 2.7\Lib")

#Imports operating system interfaces
import os

#Import directory
import_path=IN[0]

#Get file path for any files that match
output=[]

for root, subdirs, files in os.walk(import_path):
    for fn in files:
   		path=os.path.join(root,fn)		
		output.append(path)
OUT=output
# ----------------------------------------

# group: Pattern Checker
# note: Regular Expression
# Python Checker
python_script = Python(IN[0]=get_file_paths_and_name, IN[1]=stringInput)
# ---------- python_script.python (27 lines) ----------
#FileNaming pattern checker
#Created By Brendan Cassidy

import re

#Sheet pattern
#Python Regular Expressions website: https://pythex.org/
#Python regular expression info: https://docs.python.org/2.7/howto/regex.html
#Project Code, Originator and discipline are to be modified accordingly
Naming_Pattern=IN[1]

#Input
FilesFromDirectory=IN[0]

output=[]


#Checks if files match pattern
for ffd in FilesFromDirectory:
	splitFileName=ffd.split("\\")[-1]
	Tester = re.search(Naming_Pattern , splitFileName)
	if not Tester:
		output.append([ffd,splitFileName,False])
	else:
		output.append([ffd,splitFileName,True])
#Output
OUT = output
# ----------------------------------------
