# Dynamo graph Sheet Creation From Excel v0.5.dyn (Dynamo 0.9.2.4472)

# note: DYNAMO FILE NAME
# Sheet Creation From Excel v0.5.dyn
# note: DYNAMO VERSION
# 0.9.2.4472
# note: IMPORTANT NOTE!!
# Prior to the running of this script, you must understand and have read the readme file provided.

# group: Code for List checker
list_checker_code = CodeBlock()
# ---------- list_checker_code.designscript (21 lines) ----------
def list_checker(list1:var[], text_input:string)
{
ind = 0;
list2 = {};
c = [Imperative]
{
for ( i in list1)
{
if ( i == text_input)
{
list2[ind] = true;
}
else
{
list2[ind] = false;
}
ind = ind + 1;
}
}
return = list2;
};
# ----------------------------------------

# group: Project Information Section
categories = Categories("ProjectInformation")
all_elements_of_category = ElementsOfCategory(categories)
firstItem = List.FirstItem(all_elements_of_category)

# group: Project BS1192 Revit parameter
project_code_parameter_name = StringInput("ProjectCode")
originator_parameter_name = StringInput("Originator")
discipline_parameter_name = StringInput("Discipline")

# group: Excel Sheet
# note: REVIT VERSION
# Revit 2014, 2015 and 2016
# note: CREATED BY
# Brendan Cassidy
# note: DYNAMO SCRIPT PURPOSE
# This script was created to automate the creation of drawing sheets from a excel sheet(drawing register) to revit with the correct BS1192 codes, drawing border size and correct title.
# It has an inbuilt checker to eliminate any sheet numbers that have already been used, this will allow for re-use on a project as it develops through the different design stages were there can be an increase of drawing sheets.
# And an inbuilt checker that will hopefully make sure it is pushing the correct section into the correct section on the drawing borders. EG The role under BS1192 goes into the correct role parameter in revit no matter where this column is on excel sheet.
file_path = Filename("C:\Users\bc42961\Desktop\Dynamo Folder\My Scripts\000 - Excel Sheet Creation\Drawing Register - Without old titles.xlsx")
excel_sheet_tab_name = StringInput("Sheet1")

fromPath = FileObject(file_path)  # "File.FromPath"
readFromFile = Excel.ReadFromFile(file=fromPath, sheetName=excel_sheet_tab_name)

# group: Excel Row Removal
this_removes_first_few_rows = DoubleInput(5)

# group: List Trimmer
code_block = CodeBlock(lst=readFromFile, x1=this_removes_first_few_rows) { List.Transpose(List.Slice(lst,x1,List.Count(lst),1)); }

# group: Project BS1192 Excel Column Names
excel_column_name_for_project = StringInput("Project Prefix")  # "Excel column name for Project Code"
excel_column_for_organisation = StringInput("Organisation Code")  # "Excel column for Organisation Code"
excel_column_for_profession_code = StringInput("Profession Code")

# group: Project Information Checker Section
code_block_2 = CodeBlock(lst3=code_block, lst=readFromFile, code=excel_column_name_for_project) { List.GetItemAtIndex(List.Flatten(List.GetItemAtIndex(lst3, List.FilterByBoolMask(GetKeys(lst3), list_checker(lst[3], code))["in"]),1),0); }
setParameterByName = Element.SetParameterByName(element=firstItem, parameterName=project_code_parameter_name, value=code_block_2)
code_block_3 = CodeBlock(lst3=code_block, lst=readFromFile, code=excel_column_for_organisation) { List.GetItemAtIndex(List.Flatten(List.GetItemAtIndex(lst3, List.FilterByBoolMask(GetKeys(lst3), list_checker(lst[3], code))["in"]),1),0); }
setParameterByName_2 = Element.SetParameterByName(element=firstItem, parameterName=originator_parameter_name, value=code_block_3)
code_block_4 = CodeBlock(lst3=code_block, lst=readFromFile, code=excel_column_for_profession_code) { List.GetItemAtIndex(List.Flatten(List.GetItemAtIndex(lst3, List.FilterByBoolMask(GetKeys(lst3), list_checker(lst[3], code))["in"]),1),0); }
setParameterByName_3 = Element.SetParameterByName(element=firstItem, parameterName=discipline_parameter_name, value=code_block_4)

# group: Drawing Sheet BS1192 Excel Column Names
excel_column_name_for_unique = StringInput("Sequence Number")  # "Excel column name for unique number"
excel_column_name_for = StringInput("Classification")  # "Excel column name for Classification"
excel_column_name_for_drawing = StringInput("Drawing Type")  # "Excel column name for Drawing type"
excel_column_name_for_drawing_2 = StringInput("Zone")  # "Excel column name for drawing Zone"
excel_column_name_for_floor = StringInput("Floor Level")  # "Excel column name for floor level"
excel_column_name_for_drawing_3 = StringInput("Drawing Name")  # "Excel column name for drawing title"
excel_column_name_for_drawing_4 = StringInput("Size")  # "Excel column name for Drawing size"

# group: Sheet Information Checker Section
code_block_5 = CodeBlock(lst3=code_block, lst=readFromFile, code=excel_column_name_for_unique) { List.Flatten(List.GetItemAtIndex(lst3, List.FilterByBoolMask(GetKeys(lst3), list_checker(lst[3], code))["in"]),1); }
code_block_6 = CodeBlock(lst3=code_block, lst=readFromFile, code=excel_column_name_for) { List.Flatten(List.GetItemAtIndex(lst3, List.FilterByBoolMask(GetKeys(lst3), list_checker(lst[3], code))["in"]),1); }
code_block_7 = CodeBlock(lst3=code_block, lst=readFromFile, code=excel_column_name_for_drawing) { List.Flatten(List.GetItemAtIndex(lst3, List.FilterByBoolMask(GetKeys(lst3), list_checker(lst[3], code))["in"]),1); }
code_block_8 = CodeBlock(lst3=code_block, lst=readFromFile, code=excel_column_name_for_drawing_2) { List.Flatten(List.GetItemAtIndex(lst3, List.FilterByBoolMask(GetKeys(lst3), list_checker(lst[3], code))["in"]),1); }
code_block_9 = CodeBlock(lst3=code_block, lst=readFromFile, code=excel_column_name_for_floor) { List.Flatten(List.GetItemAtIndex(lst3, List.FilterByBoolMask(GetKeys(lst3), list_checker(lst[3], code))["in"]),1); }
code_block_10 = CodeBlock(lst3=code_block, lst=readFromFile, code=excel_column_name_for_drawing_3) { List.Flatten(List.GetItemAtIndex(lst3, List.FilterByBoolMask(GetKeys(lst3), list_checker(lst[3], code))["in"]),1); }
code_block_11 = CodeBlock(lst3=code_block, lst=readFromFile, code=excel_column_name_for_drawing_4) { List.Flatten(List.GetItemAtIndex(lst3, List.FilterByBoolMask(GetKeys(lst3), list_checker(lst[3], code))["in"]),1); }

# group: Drawing Size's for filter
code_block_12 = CodeBlock()
# ---------- code_block_12.designscript (6 lines) ----------
//Drawing size checks

"A0";
"A1";
"A2";
"A3";
# ----------------------------------------

# group: Revit border Families
# note: A0 Drawing Border Name
a0_drawing_border_name = FamilyTypes("XYZ_A0-V Company:XYZ_A0-V Location")
# note: A1 Drawing Border Name
a1_drawing_border_name = FamilyTypes("XYZ_A1-V Company:XYZ_A1-V Location")
# note: A2 Drawing Border Name
a2_drawing_border_name = FamilyTypes("XYZ_A2-V Company:XYZ_A2-V Location")
# note: A3 Drawing Border Name
a3_drawing_border_name = FamilyTypes("XYZ_A3-V Company:XYZ_A3-V Location")

# group: Sheet Border adder
python_script = Python(IN[0]=code_block_11, IN[1]=code_block_12.out0, IN[2]=code_block_12.out1, IN[3]=code_block_12.out2, IN[4]=code_block_12.out3, IN[5]=a0_drawing_border_name, IN[6]=a1_drawing_border_name, IN[7]=a2_drawing_border_name, IN[8]=a3_drawing_border_name)
# ---------- python_script.python (31 lines) ----------
import clr
clr.AddReference('ProtoGeometry')
from Autodesk.DesignScript.Geometry import *
#The inputs to this node will be stored as a list in the IN variables.

List_Check=IN[0]

Size_A0=IN[1]
Size_A1=IN[2]
Size_A2=IN[3]
Size_A3=IN[4]

Family_A0=IN[5]
Family_A1=IN[6]
Family_A2=IN[7]
Family_A3=IN[8]

output=[]

for a in List_Check:
	if a == Size_A0:
		output.append(Family_A0)
	elif a == Size_A1:
		output.append(Family_A1)
	elif a == Size_A2:
		output.append(Family_A2)
	elif a == Size_A3:
		output.append(Family_A3)

#Assign your output to the OUT variable.
OUT = output
# ----------------------------------------

# group: Sheet Category
categories_2 = Categories("Sheets")
all_elements_of_category_2 = ElementsOfCategory(categories_2)
sheetNumber = Sheet.SheetNumber(all_elements_of_category_2)

# group: List Re-organiser, Trimmer And Null Checker
code_block_13 = CodeBlock(a=code_block_5, b=code_block_6, c=code_block_7, d=code_block_8, e=code_block_9, f=code_block_10, g=code_block_11, h=python_script, Sheetnumber=sheetNumber) { lst4 = List.FilterByBoolMask(List.Transpose({a,b,c,d,e,f,g,h}),List.ContainsItem(Sheetnumber,a))["out"]; }
python_script_2 = Python(IN[0]=code_block_13)
# ---------- python_script_2.python (75 lines) ----------
#Created By Brendan Cassidy

#Libraries
import clr
clr.AddReference('ProtoGeometry')
from Autodesk.DesignScript.Geometry import *

clr.AddReference('DSCoreNodes')
import DSCore
from DSCore import *

clr.AddReference('Display')
import Display
from Display import *


#Input
lst=IN[0]

#Counts total number of null elements
if lst:
	temp_output=[]
	for a in lst:
		temp_count=0
		for b in a:
			if not b:
				temp_count=(temp_count+1)
		temp_output.append(temp_count)

	#Counts total elements in sublist
	Total=len(lst[0])

	#counts partial null values and
	#outputs content with zero null values
	null_count=0
	output=[]

	count=0
	for a in lst:
		if 0 < temp_output[count] < Total:
 	 		count=(count+1)
 	 		null_count=(null_count+1)
		elif temp_output[count] == 0:
			count=(count+1)
 			output.append(a)
 		else:
 			count=(count+1)


	#Warning text output
	if len(output) > 0:
		if null_count == 0:
			Output_text="There were no drawings from the \nexcel sheet that had some elements as \nnull values. Therefore all drawings \nsheets that was not already in revit\nhave been created in revit."
			Output_Color=Color.ByARGB(255, 0, 250, 050)
		else:
			Output_text="There are " + str(null_count) + " total drawings from the \nexcel sheet that have some null \nelements within. Therefore you will \nneed to sort these prior to them \nbeing created in revit."
			Output_Color=Color.ByARGB(255, 250, 130, 050)
	else:
		Output_text="There are no drawing sheets to process"
		Output_Color=Color.ByARGB(255, 250, 0, 0)
else:
	Output_text="There are no drawing sheets to process"
	Output_Color=Color.ByARGB(255, 250, 0, 0)
	output=[]

#Cubiod indicator
So=Cuboid.ByLengths(10,10,10)
Eo=So.Edges
Offset=1
Output_Solid=Solid.Fillet(So,Eo,Offset)

OSC=Display.ByGeometryColor(Output_Solid,Output_Color)

#Output
OUT=[output,Output_text,OSC]
# ----------------------------------------
code_block_14 = CodeBlock(a=python_script_2) { a[1]; a[0]; }

# group: Error Indicator
watch = Watch(code_block_14.out0)

# group: Random View
random_view = Views("00_Dummy_View")

# group: Revit BS1192 Sheet Parameter
drawing_type_parameter_name = StringInput("Drawing Type")
# note: BS1192 Revit parameters
classification_parameter_name = StringInput("Classification")
zone_parameter_name = StringInput("Zone")
sheet_size_parameter_name = StringInput("Sheet Size")
floor_level_parameter_name = StringInput("Floor Level")

# group: Sheet Creator
transpose = List.Transpose(code_block_14.out1)
create_independant_lists = CodeBlock(list=transpose) { list[0]; list[1]; list[2]; list[3]; list[4]; list[5]; list[6]; list[7]; }
byNameNumberTitleBlockAndView = Sheet.ByNameNumberTitleBlockAndView(sheetName=create_independant_lists.out5, sheetNumber=create_independant_lists.out0, titleBlockFamilyType=create_independant_lists.out7, view=random_view)
setParameterByName_4 = Element.SetParameterByName(element=byNameNumberTitleBlockAndView, parameterName=drawing_type_parameter_name, value=create_independant_lists.out2)
setParameterByName_5 = Element.SetParameterByName(element=byNameNumberTitleBlockAndView, parameterName=classification_parameter_name, value=create_independant_lists.out1)
setParameterByName_6 = Element.SetParameterByName(element=byNameNumberTitleBlockAndView, parameterName=zone_parameter_name, value=create_independant_lists.out3)
setParameterByName_7 = Element.SetParameterByName(element=byNameNumberTitleBlockAndView, parameterName=sheet_size_parameter_name, value=create_independant_lists.out6)
setParameterByName_8 = Element.SetParameterByName(element=byNameNumberTitleBlockAndView, parameterName=floor_level_parameter_name, value=create_independant_lists.out4)
