# Dynamo graph Sheet Creation From Excel with code joiner v0.5.dyn (Dynamo 1.2.0.2690)

# note: DYNAMO FILE NAME
# Sheet Creation From Excel with code joiner v0.5.dyn
# note: IMPORTANT NOTE!!
# Prior to the running of this script, you must understand and have read the readme file provided.

# group: Excel Sheet
# note: REVIT VERSION
# Revit 2014, 2015 and 2016
# note: CREATED BY
# Brendan Cassidy
# note: DYNAMO VERSION
# 0.9.2.4472
# note: DYNAMO SCRIPT PURPOSE
# This script was created to automate the creation of drawing sheets from a excel sheet(drawing register) to revit with the correct BS1192 codes, drawing border size and correct title.
# It has an inbuilt checker to eliminate any sheet numbers that have already been used, this will allow for re-use on a project as it develops through the different design stages were there can be an increase of drawing sheets.
# And an inbuilt checker that will hopefully make sure it is pushing the correct section into the correct section on the drawing borders. EG The role under BS1192 goes into the correct role parameter in revit no matter where this column is on excel sheet.
file_path = Filename("C:\Users\bc42961\Desktop\Dynamo Folder\My Scripts\000 - Excel Sheet Creation\Drawing Register - Without old titles.xlsx")
excel_sheet_tab_name = StringInput("Sheet1")

fromPath = FileObject(file_path)  # "File.FromPath"
readFromFile = Excel.ReadFromFile(file=fromPath, sheetName=excel_sheet_tab_name)

# group: Excel Row Removal
this_removes_first_few_rows = DoubleInput(4)

# group: List Trimmer
code_block = CodeBlock(lst=readFromFile, x1=this_removes_first_few_rows) { List.Transpose(List.Slice(lst,x1,List.Count(lst),1)); }

# group: Project BS1192 Excel Column Names
excel_column_name_for_project = StringInput("Project Prefix")  # "Excel column name for Project Code"
excel_column_for_organisation = StringInput("Organisation Code")  # "Excel column for Organisation Code"

# group: Project Information Section
categories = Categories("ProjectInformation")
all_elements_of_category = ElementsOfCategory(categories)
firstItem = List.FirstItem(all_elements_of_category)

# group: Project BS1192 Revit parameter
project_code_parameter_name = StringInput("ProjectCode")
originator_parameter_name = StringInput("Originator")

# group: Project Information Checker Section
code_block_2 = CodeBlock(lst3=code_block, lst=readFromFile, code=excel_column_name_for_project) { List.GetItemAtIndex(List.Flatten(List.GetItemAtIndex(lst3, List.FilterByBoolMask(GetKeys(lst3), list_checker(lst[3], code))["in"]),1),0); }
code_block_3 = CodeBlock(lst3=code_block, lst=readFromFile, code=excel_column_for_organisation) { List.GetItemAtIndex(List.Flatten(List.GetItemAtIndex(lst3, List.FilterByBoolMask(GetKeys(lst3), list_checker(lst[3], code))["in"]),1),0); }
setParameterByName = Element.SetParameterByName(element=firstItem, parameterName=project_code_parameter_name)  # unwired: value
setParameterByName_2 = Element.SetParameterByName(element=firstItem, parameterName=originator_parameter_name)  # unwired: value

# group: Code for List checker
list_checker_code = CodeBlock()
# ---------- list_checker_code.designscript (21 lines) ----------
def list_checker(list1:var[], text_input:string)
{
ind = 0;
list2 = {};
c = [Imperative]
{
for ( i in list1)
{
if ( i == text_input)
{
list2[ind] = true;
}
else
{
list2[ind] = false;
}
ind = ind + 1;
}
}
return = list2;
};
# ----------------------------------------

# group: Sheet Category
categories_2 = Categories("Sheets")
all_elements_of_category_2 = ElementsOfCategory(categories_2)
sheetNumber = Sheet.SheetNumber(all_elements_of_category_2)

# group: Drawing Sheet BS1192 Excel Column Names
excel_column_name_for_unique = StringInput("Sequence Number")  # "Excel column name for unique number"
excel_column_name_for = StringInput("Classification")  # "Excel column name for Classification"
excel_column_name_for_drawing = StringInput("Drawing Type")  # "Excel column name for Drawing type"
excel_column_name_for_drawing_2 = StringInput("Zone")  # "Excel column name for drawing Zone"
excel_column_name_for_floor = StringInput("Floor Level")  # "Excel column name for floor level"
excel_column_for_profession_code = StringInput("Profession Code")
excel_column_name_for_drawing_3 = StringInput("Drawing Name")  # "Excel column name for drawing title"
excel_column_name_for_drawing_4 = StringInput("Size")  # "Excel column name for Drawing size"

# group: Sheet Information Checker Section
code_block_4 = CodeBlock(lst3=code_block, lst=readFromFile, code=excel_column_name_for_unique) { List.Flatten(List.GetItemAtIndex(lst3, List.FilterByBoolMask(GetKeys(lst3), list_checker(lst[3], code))["in"]),1); }
code_block_5 = CodeBlock(lst3=code_block, lst=readFromFile, code=excel_column_name_for) { List.Flatten(List.GetItemAtIndex(lst3, List.FilterByBoolMask(GetKeys(lst3), list_checker(lst[3], code))["in"]),1); }
code_block_6 = CodeBlock(lst3=code_block, lst=readFromFile, code=excel_column_name_for_drawing) { List.Flatten(List.GetItemAtIndex(lst3, List.FilterByBoolMask(GetKeys(lst3), list_checker(lst[3], code))["in"]),1); }
code_block_7 = CodeBlock(lst3=code_block, lst=readFromFile, code=excel_column_name_for_drawing_2) { List.Flatten(List.GetItemAtIndex(lst3, List.FilterByBoolMask(GetKeys(lst3), list_checker(lst[3], code))["in"]),1); }
code_block_8 = CodeBlock(lst3=code_block, lst=readFromFile, code=excel_column_name_for_floor) { List.Flatten(List.GetItemAtIndex(lst3, List.FilterByBoolMask(GetKeys(lst3), list_checker(lst[3], code))["in"]),1); }
code_block_9 = CodeBlock(lst3=code_block, lst=readFromFile, code=excel_column_for_profession_code) { List.Flatten(List.GetItemAtIndex(lst3, List.FilterByBoolMask(GetKeys(lst3), list_checker(lst[3], code))["in"]),1); }
code_block_10 = CodeBlock(lst3=code_block, lst=readFromFile, code=excel_column_name_for_drawing_3) { List.Flatten(List.GetItemAtIndex(lst3, List.FilterByBoolMask(GetKeys(lst3), list_checker(lst[3], code))["in"]),1); }
code_block_11 = CodeBlock(lst3=code_block, lst=readFromFile, code=excel_column_name_for_drawing_4) { List.Flatten(List.GetItemAtIndex(lst3, List.FilterByBoolMask(GetKeys(lst3), list_checker(lst[3], code))["in"]),1); }

# group: Drawing Size's for filter
code_block_12 = CodeBlock()
# ---------- code_block_12.designscript (6 lines) ----------
//Drawing size checks

"A0";
"A1";
"A2";
"A3";
# ----------------------------------------

# group: Revit border Families
# note: A0 Drawing Border Name
a0_drawing_border_name = FamilyTypes("XYZ_A0-V Company:XYZ_A0-V Location")
# note: A1 Drawing Border Name
a1_drawing_border_name = FamilyTypes("XYZ_A1-V Company:XYZ_A1-V Location")
# note: A2 Drawing Border Name
a2_drawing_border_name = FamilyTypes("XYZ_A2-V Company:XYZ_A2-V Location")
# note: A3 Drawing Border Name
a3_drawing_border_name = FamilyTypes("XYZ_A3-V Company:XYZ_A3-V Location")

# group: Sheet Border adder
python_script = Python(IN[0]=code_block_11, IN[1]=code_block_12.out0, IN[2]=code_block_12.out1, IN[3]=code_block_12.out2, IN[4]=code_block_12.out3, IN[5]=a0_drawing_border_name, IN[6]=a1_drawing_border_name, IN[7]=a2_drawing_border_name, IN[8]=a3_drawing_border_name)
# ---------- python_script.python (33 lines) ----------
#Created By Brendan Cassidy

import clr
clr.AddReference('ProtoGeometry')
from Autodesk.DesignScript.Geometry import *
#The inputs to this node will be stored as a list in the IN variables.

List_Check=IN[0]

Size_A0=IN[1]
Size_A1=IN[2]
Size_A2=IN[3]
Size_A3=IN[4]

Family_A0=IN[5]
Family_A1=IN[6]
Family_A2=IN[7]
Family_A3=IN[8]

output=[]

for a in List_Check:
	if a == Size_A0:
		output.append(Family_A0)
	elif a == Size_A1:
		output.append(Family_A1)
	elif a == Size_A2:
		output.append(Family_A2)
	elif a == Size_A3:
		output.append(Family_A3)

#Assign your output to the OUT variable.
OUT = output
# ----------------------------------------

# group: List Joiner And Null Removal
code_block_13 = CodeBlock(a=code_block_4, b=code_block_5, c=code_block_6, d=code_block_7, e=code_block_8, f=code_block_9, g=code_block_10, h=code_block_11, i=python_script) { List.Transpose({a,b,c,d,e,f,g,h,i}); }
python_script_2 = Python(IN[0]=code_block_13)
# ---------- python_script_2.python (64 lines) ----------
#Created By Brendan Cassidy

#Libraries
import clr
clr.AddReference('ProtoGeometry')
from Autodesk.DesignScript.Geometry import *

clr.AddReference('DSCoreNodes')
import DSCore
from DSCore import *

clr.AddReference('Display')
import Display
from Display import *


#Input
lst=IN[0]

#Counts total number of null elements
temp_output=[]
for a in lst:
	temp_count=0
	for b in a:
		if not b:
			temp_count=(temp_count+1)
	temp_output.append(temp_count)

#Counts total elements in sublist
Total=len(lst[0])

#counts partial null values and
#outputs content with zero null values
null_count=0
output=[]

count=0
for a in lst:
	if 0 < temp_output[count] < Total:
  		count=(count+1)
  		null_count=(null_count+1)
	elif temp_output[count] == 0:
		count=(count+1)
 		output.append(a)
 	else:
 		count=(count+1)


#Warning text output
if null_count == 0:
	Output_text="There were no drawings from the \nexcel sheet that had some elements as \nnull values. Therefore all drawings \nsheets that was not already in revit\nhave been created in revit."

else:
	Output_text="There are " + str(null_count) + " total drawings from the \nexcel sheet that have some null \nelements within. Therefore you will \nneed to sort these prior to them \nbeing created in revit."


#Cubiod indicator
So=Cuboid.ByLengths(10,10,10)
Eo=So.Edges
Offset=1
Output_Solid=Solid.Fillet(So,Eo,Offset)

#Output
OUT=[output,[Output_text,Output_Solid]]
# ----------------------------------------
code_block_14 = CodeBlock(a=python_script_2) { a[1]; a[0]; }

# group: Drawing Number Arrangement
zone_position = StringInput("0")
floor_level_position = StringInput("1")
type_position = StringInput("2")
role_position = StringInput("3")
classification_position = StringInput("4")
number_position = StringInput("5")

create = List.Create(zone_position, floor_level_position, type_position, role_position, classification_position, number_position)
seporator = CodeBlock { "-"; }

# group: Drawing Name Joiner
transpose = List.Transpose(code_block_14.out1)
create_independant_lists = CodeBlock(list=transpose) { {list[3],list[4],list[2],list[5],list[1],list[0]}; list[6]; list[7]; list[8]; }
python_script_3 = Python(IN[0]=create_independant_lists.out0, IN[1]=create, IN[2]=seporator)
# ---------- python_script_3.python (23 lines) ----------
#Created By Brendan Cassidy

#Input
Arrangement=[IN[1]]
Text_input=zip(*IN[0])
output=[]

#Joins list input and specified arrangement list

list_Join=zip(*Arrangement + Text_input)

#Sorts and transposes list
Text_rearrange=zip(*sorted(list_Join, key=lambda list_Join:(list_Join[0])))

Text_Seporator=IN[2]
	
#Joins each sub code together
for a in Text_rearrange:
	Temp_Output=str(a[0]) + Text_Seporator + str(a[1]) + Text_Seporator + str(a[2]) + Text_Seporator + str(a[3]) + Text_Seporator + str(a[4]) + Text_Seporator + str(a[5])
	output.append(Temp_Output)

#Output
OUT=output[1:]
# ----------------------------------------

# group: Random View
random_view = Views("00_Dummy_View")

# group: Revit Sheet Parameter
sheet_size_parameter_name = StringInput("Sheet Size")

# group: Filter Out Existing Sheets And Sheet Creator
code_block_15 = CodeBlock(Sheetnumber=sheetNumber, a=python_script_3, b=create_independant_lists.out1, c=create_independant_lists.out3, d=create_independant_lists.out2)
# ---------- code_block_15.designscript (7 lines) ----------
lst=List.ContainsItem(Sheetnumber,a);
lst1=List.FilterByBoolMask(List.Transpose({a,b,c,d}),lst)["out"];
lst2=List.Transpose(lst1);
lst2[0];
lst2[1];
lst2[2];
lst2[3];
# ----------------------------------------
byNameNumberTitleBlockAndView = Sheet.ByNameNumberTitleBlockAndView(sheetName=code_block_15.out4, sheetNumber=code_block_15.out3, titleBlockFamilyType=code_block_15.out5, view=random_view)
setParameterByName_3 = Element.SetParameterByName(element=byNameNumberTitleBlockAndView, parameterName=sheet_size_parameter_name, value=code_block_15.out6)

# group: Error Indicator Checker
python_script_4 = Python(IN[0]=code_block_14.out0, IN[1]=code_block_15.lst1)
# ---------- python_script_4.python (45 lines) ----------
#Created By Brendan Cassidy

#Libraries
import clr
clr.AddReference('ProtoGeometry')
from Autodesk.DesignScript.Geometry import *

clr.AddReference('DSCoreNodes')
import DSCore
from DSCore import *

clr.AddReference('Display')
import Display
from Display import *

#Input
Error_text=IN[0][0]
Error_geometry=IN[0][1]

Error_check_text="There were no drawings from the \nexcel sheet that had some elements as \nnull values. Therefore all drawings \nsheets that was not already in revit\nhave been created in revit."

lst=IN[1]



#Warning text output
if not lst:
	Output_text="There are no drawing sheets to process"
	Output_Color=Color.ByARGB(255, 250, 0, 0)
else:
	if Error_text == Error_check_text:
		Output_text=Error_text
		Output_Color=Color.ByARGB(255, 0, 250, 050)
	else:
		Output_text=Error_text
		Output_Color=Color.ByARGB(255, 250, 130, 050)

#Cubiod indicator


OSC=Display.ByGeometryColor(Error_geometry,Output_Color)

#OUT=temp_output
#Output
OUT=[Output_text,OSC]
# ----------------------------------------
code_block_16 = CodeBlock(a=python_script_4) { a[0]; }

# group: Error Indicator
watch = Watch(code_block_16)
