# Dynamo graph Sheet Creation From Excel with code joiner.dyn (Dynamo 1.3.2.2480)

# group: Dynamo Script Information
# note: REVIT VERSION
# Revit 2015 ,2016 and 2017
# note: CREATED BY
# Brendan Cassidy
# note: DYNAMO VERSION
# 1.3.1
# note: DYNAMO FILE NAME
# Sheet Creation From Excel with code joiner v0.6.dyn
# note: DYNAMO SCRIPT PURPOSE
# This script was created to automate the creation of drawing sheets from a excel sheet(drawing register) to revit with the correct BS1192 codes, drawing border size and correct title.
# It has an inbuilt checker to eliminate any sheet numbers that have already been used, this will allow for re-use on a project as it develops through the different design stages were there can be an increase of drawing sheets.
# And an inbuilt checker that will hopefully make sure it is pushing the correct section into the correct section on the drawing borders. EG The role under BS1192 goes into the correct role parameter in revit no matter where this column is on excel sheet.
# note: IMPORTANT NOTE!!
# Prior to the running of this script, you must understand and have read the readme file provided.

# group: Project Information Section
categories = Categories("ProjectInformation")
all_elements_of_category = ElementsOfCategory(categories)
firstItem = List.FirstItem(all_elements_of_category)

# group: Project BS1192 Revit parameter
project_code_parameter_name = StringInput("ProjectCode")
originator_parameter_name = StringInput("Originator")

# group: UI Input
codeBlock = CodeBlock()
# ---------- codeBlock.designscript (13 lines) ----------
{{"Excel Sheet file:",
"Sheet Tab Name:",
"A0 Title Block:",
"A1 Title Block:",
"A2 Title Block:",
"A3 Title Block:",
"Empty Drafting View:"},
{"Zone Position:",
"Floor Level Postion:",
"Type Position:",
"Role Position:",
"Classification:",
"Number Position:"}};
# ----------------------------------------
get_all_title_block_families = Python()  # unwired: IN[0]
# ---------- get_all_title_block_families.python (21 lines) ----------
#Created By Brendan Cassidy

import clr
clr.AddReference('RevitAPI')
from Autodesk.Revit.DB import *

clr.AddReference("RevitServices")
import RevitServices
from RevitServices.Persistence import DocumentManager

doc = DocumentManager.Instance.CurrentDBDocument

collector = FilteredElementCollector(doc)
collector.OfClass(FamilySymbol)
collector.OfCategory(BuiltInCategory.OST_TitleBlocks)

elementlist = list()
for a in collector:
	elementlist.append(a)
	
OUT = elementlist
# ----------------------------------------
get_all_views = Python()  # unwired: IN[0]
# ---------- get_all_views.python (21 lines) ----------
#Created By Brendan Cassidy

import clr
clr.AddReference('RevitAPI')
from Autodesk.Revit.DB import *

clr.AddReference("RevitServices")
import RevitServices
from RevitServices.Persistence import DocumentManager

doc = DocumentManager.Instance.CurrentDBDocument

collector = FilteredElementCollector(doc)
collector.OfCategory(BuiltInCategory.OST_Views)

elementlist = list()
for a in collector:
	if not a.IsTemplate:
		elementlist.append(a)
	
OUT = elementlist
# ----------------------------------------
codeBlock_2 = CodeBlock(a=get_all_title_block_families, b=get_all_views)
# ---------- codeBlock_2.designscript (2 lines) ----------
{{"fp","s",a,a,a,a,b},
{"s","s","s","s","s","s"}};
# ----------------------------------------
boolSelector = BoolSelector(false)
download_uk_dynamo_group_image = Python()
# ---------- download_uk_dynamo_group_image.python (44 lines) ----------
#Created By Brendan Cassidy
#https://github.com/brencass/DynamoGraphs

import clr
import sys
sys.path.append("C:\Program Files (x86)\IronPython 2.7\Lib")
import os
from time import sleep

from System.Net import HttpWebRequest,WebRequest,WebResponse
from System.IO import StreamReader
from System.IO import File
from System import IO

clr.AddReference('System.Drawing')
from System.Drawing import Image, Imaging

ImageUrlToDownload="https://raw.githubusercontent.com/brencass/DynamoGraphs/master/ZZZZ-Anything%20Not%20Script%20Related/UKDynamoUserGroup.png"
Path=IO.Path.GetTempPath() + "UKDynamoUserGroup.png"

output=[]


if os.path.exists(Path):
	output.append(Path)
else:
	for a in [ImageUrlToDownload]:
	
		myHttpWebRequest=WebRequest.Create(a)
		myHttpWebRequest.MaximumAutomaticRedirections=5
		myHttpWebRequest.AllowAutoRedirect=True
		myHttpWebRequest.Timeout=120000
		myHttpWebResponse=myHttpWebRequest.GetResponse()
		tempstream=myHttpWebResponse.GetResponseStream()
		
		img = Image.FromStream(tempstream)
	
		img.Save(IO.Path.GetTempPath() + "UKDynamoUserGroup.png", Imaging.ImageFormat.Png)
		
		output.append(Path)

sleep(30)

OUT=output[0]
# ----------------------------------------
python_script = Python(IN[0]=codeBlock, IN[1]=codeBlock_2, IN[2]=boolSelector, IN[3]=download_uk_dynamo_group_image)
# ---------- python_script.python (231 lines) ----------
#Copyright (c) mostafa el ayoubi ,  2016
#Data-Shapes www.data-shapes.net , elayoubi.mostafa@gmail.com

#Error checking and capture added by Brendan Cassidy, Twitter Handle: @Brencass86
#Used to stop the code from saying no module/crashing when not run in a revit instance
#System used is similar to how archi-labs captures errors.

import clr
import sys

import sys
sys.path.append("C:\Program Files (x86)\IronPython 2.7\Lib")

clr.AddReference('System.Windows.Forms')
clr.AddReference('System.Drawing')

from System.Drawing import Point, Image, Size, ContentAlignment, Font, FontStyle
from System.Windows.Forms import Application, Button, Form, Label, TextBox, CheckBox, FolderBrowserDialog, OpenFileDialog, DialogResult, ComboBox, FormBorderStyle, SizeGripStyle, PictureBox, PictureBoxSizeMode, DockStyle
from System.Collections.Generic import *

import os

try:
	errorReport = None
	clr.AddReference('RevitAPIUI')
	from  Autodesk.Revit.UI import Selection

	clr.AddReference('RevitNodes')
	import Revit
	clr.ImportExtensions(Revit.Elements)
	clr.ImportExtensions(Revit.GeometryConversion)

	clr.AddReference('RevitServices')
	from RevitServices.Persistence import DocumentManager
	doc = DocumentManager.Instance.CurrentDBDocument
	uidoc = DocumentManager.Instance.CurrentUIApplication.ActiveUIDocument

	class MultiTextBoxForm(Form):
	
		def __init__(self):
			self.Text = 'Excel to revit Sheet creator'
			self.MinimizeBox= False
			self.MaximizeBox= False
			self.ShowIcon = False
			self.FormBorderStyle = FormBorderStyle.FixedDialog
			self.SizeGripStyle = SizeGripStyle.Hide
			self.output = []
			self.values = []

		def setclose(self, sender, event):
			cbindexread = 0
			for f in self.output:
				if f.GetType() == TextBox:
					self.values.append(f.Text)
				if f.GetType() == CheckBox:
					self.values.append(f.Checked)
				if f.GetType() == Button:
					if f.Tag == None :
						self.values.append(f.Text)
					else:
						self.values.append(f.Tag)
				if f.GetType() == ComboBox:
					self.values.append(globals() ['dict%d'%(cbindexread)][f.Text])
					cbindexread += 1
			self.Close()

		def reset(self, sender, event):
			pass

		def openfile(self, sender, event):
			ofd = OpenFileDialog()
			ofd.Filter = "Excel files (*.xls or .xlsx)|.xls;*.xlsx"
			ofd.InitialDirectory = "::{20D04FE0-3AEA-1069-A2D8-08002B30309D}"
			dr = ofd.ShowDialog()
			if dr == DialogResult.OK:
				sender.Text = ofd.FileName

		def topmost(self):
			self.TopMost = True

	form = MultiTextBoxForm()
	form.topmost()

	xlabel = 25
	xinput = 175
	y = 10
	fields = []
	error = 0
	cbindex = 0
	#Input form

	for i,j in zip(IN[0][0],IN[1][0]):
		label = Label()
		label.AutoSize = True
		label.Location = Point(xlabel,y+4)
		label.Height = 20
		label.Width = 80
		label.Font = Font("Serif", 8.5, FontStyle.Regular)
		label.Text = str(i)
		form.Controls.Add(label)
		if isinstance(j,list):
			cb = ComboBox()
			cb.Location = Point(xinput,y)
			cb.Width = 150
			globals()['dict%d'%(cbindex)] = {}
			try :
				for k in j:
					globals()['dict%d'%(cbindex)][k.Name] = k
					cb.Items.Add(k.Name)
			except :
				for k in j:
					globals()['dict%d'%(cbindex)][str(k)] = k
					cb.Items.Add(k)
			form.Controls.Add(cb)
			form.output.append(cb)
			cbindex += 1
		elif j == 's':
			tb = TextBox()
			tb.Text = 'Sheet1'
			tb.Width = 150
			tb.Location = Point(xinput,y)
			form.Controls.Add(tb)
			form.Controls.Add(label)
			form.output.append(tb)
		elif j == 'fp':
			fp = Button()
			fp.Width = 150
			fp.Text = 'FilePath'
			fp.Location = Point(xinput,y)
			form.Controls.Add(fp)
			fp.Click += form.openfile
			form.output.append(fp)
		else :
			error = ["" ,"" ,"" ,"" ,"" ,"" ,"" ,"" ,"" ,"" ,"" ,"" ,"" ,['One or more input types are invalid, visit www.data-shapes.net for more informations']]
		y+= 30
		
	Position_Detault=0
	for i,j in zip(IN[0][1],IN[1][1]):
		label = Label()
		label.AutoSize = True
		label.Location = Point(xlabel,y+4)
		label.Height = 20
		label.Width = 80
		label.Font = Font("Serif", 8.5, FontStyle.Regular)
		label.Text = str(i)
		form.Controls.Add(label)
		tb = TextBox()
		tb.Text = str(Position_Detault)
		tb.Width = 150
		tb.Location = Point(xinput,y)
		form.Controls.Add(tb)
		form.Controls.Add(label)
		form.output.append(tb) 
		y+= 30
		Position_Detault+=1

	
	Side_Text_Font = Font("Arial", 8, FontStyle.Regular)
	
	EF_Label = Label()
	EF_Label.AutoSize = False
	EF_Label.Height = 175
	EF_Label.Width = 340
	EF_Label.Location = Point((xlabel+310),30)
	EF_Label.TextAlign = ContentAlignment.TopLeft
	EF_Label.Text = "Excel file location and excel sheet tab name"
	EF_Label.Font = Side_Text_Font
	form.Controls.Add(EF_Label)		
	
	
	BS_Label = Label()
	BS_Label.AutoSize = False
	BS_Label.Height = 175
	BS_Label.Width = 340
	BS_Label.Location = Point((xlabel+310),220)
	BS_Label.TextAlign = ContentAlignment.TopLeft
	BS_Label.Text = "Drawing number with the following arrangement\n\"Zone-Floor Level-Type-Role-Classification-Number\" will have the following numbers within each of the position boxes: \n\n      Zone Position = 0\n      Floor Level Position = 1\n      Type Position = 2\n      Role Position = 3\n      Classification Position = 4\n      Number Position = 5"
	BS_Label.Font = Side_Text_Font
	form.Controls.Add(BS_Label)		
			
	#Bottom left Image from a inputted image.
	#pathToFile=URL.read()
	if os.path.isfile(IN[3]):
		pathToFile=IN[3]
		image=Image.FromFile(pathToFile)
		pictureBox = PictureBox()
		pictureBox.Image = image
		pictureBox.Location = Point (15,y+15)
		pictureBox.Size = Size(125, 30)
		pictureBox.SizeMode = PictureBoxSizeMode.Zoom
		form.Controls.Add(pictureBox)
	
	button = Button()
	button.Text = 'Run Script'
	button.Width = 100
	button.Location = Point (540,y)
	button.Click += form.setclose
	form.Controls.Add(button)
		
	Dis_Font = Font("Arial", 7, FontStyle.Regular)
	
	Dis_Label = Label()
	Dis_Label.AutoSize = False
	Dis_Label.Height = 50
	Dis_Label.Width = 450
	Dis_Label.Location = Point(190,y+10)
	Dis_Label.TextAlign = ContentAlignment.BottomRight
	Dis_Label.Text = "Origanal UI code by Mostafa El Ayoubi(@data_shapes). \nStyles added and code modified for this script by Brendan Cassidy(@brencass86)."
	Dis_Label.Font = Dis_Font
	form.Controls.Add(Dis_Label)
		
	form.Height = y + 130
	form.Width = 680
		
except:
	# if error accurs anywhere in the process catch it
	import traceback
	errorReport = traceback.format_exc()

if errorReport == None:
	if error == 0:
		Application.Run(form)
		if len(form.values) != len(set(form.values)):
			OUT = ["" ,"" ,"" ,"" ,"" ,"" ,"" ,"" ,"" ,"" ,"" ,"" ,"" ,["Two or more values for UI match. No values should match"]]
		else:
			OUT  = [form.values,"Completed"]

	else :
		OUT  = error
else:
	OUT=errorReport
# ----------------------------------------

codeBlock_3 = CodeBlock(a=python_script) { a[0][0]; a[0][1]; }
fromPath = FileObject(codeBlock_3.out0)  # "File.FromPath"
readFromFile = Excel.ReadFromFile(file=fromPath, sheetName=codeBlock_3.out1)

# group: Excel Row Removal
this_removes_first_few_rows = DoubleInput(4)

# group: List Trimmer
code_block = CodeBlock(lst=readFromFile, x1=this_removes_first_few_rows) { List.Transpose(List.Slice(lst,x1,List.Count(lst),1)); }

# group: Project BS1192 Excel Column Names
excel_column_name_for_project = StringInput("Project Prefix")  # "Excel column name for Project Code"
excel_column_for_organisation = StringInput("Organisation Code")  # "Excel column for Organisation Code"

# group: Project Information Checker Section
code_block_2 = CodeBlock(lst3=code_block, lst=readFromFile, code=excel_column_name_for_project) { List.GetItemAtIndex(List.Flatten(List.GetItemAtIndex(lst3, List.FilterByBoolMask(GetKeys(lst3), list_checker(lst[3], code))["in"]),1),0); }
setParameterByName = Element.SetParameterByName(element=firstItem, parameterName=project_code_parameter_name, value=code_block_2)
code_block_3 = CodeBlock(lst3=code_block, lst=readFromFile, code=excel_column_for_organisation) { List.GetItemAtIndex(List.Flatten(List.GetItemAtIndex(lst3, List.FilterByBoolMask(GetKeys(lst3), list_checker(lst[3], code))["in"]),1),0); }
setParameterByName_2 = Element.SetParameterByName(element=firstItem, parameterName=originator_parameter_name, value=code_block_3)

# group: Code for List checker
list_checker_code = CodeBlock()
# ---------- list_checker_code.designscript (21 lines) ----------
def list_checker(list1:var[], text_input:string)
{
ind = 0;
list2 = {};
c = [Imperative]
{
for ( i in list1)
{
if ( i == text_input)
{
list2[ind] = true;
}
else
{
list2[ind] = false;
}
ind = ind + 1;
}
}
return = list2;
};
# ----------------------------------------

# group: Drawing Sheet BS1192 Excel Column Names
excel_column_name_for_unique = StringInput("Sequence Number")  # "Excel column name for unique number"
excel_column_name_for = StringInput("Classification")  # "Excel column name for Classification"
excel_column_name_for_drawing = StringInput("Drawing Type")  # "Excel column name for Drawing type"
excel_column_name_for_drawing_2 = StringInput("Zone")  # "Excel column name for drawing Zone"
excel_column_name_for_floor = StringInput("Floor Level")  # "Excel column name for floor level"
excel_column_for_profession_code = StringInput("Profession Code")
excel_column_name_for_drawing_3 = StringInput("Drawing Name")  # "Excel column name for drawing title"
excel_column_name_for_drawing_4 = StringInput("Size")  # "Excel column name for Drawing size"

# group: Sheet Information Checker Section
code_block_4 = CodeBlock(lst3=code_block, lst=readFromFile, code=excel_column_name_for_unique) { List.Flatten(List.GetItemAtIndex(lst3, List.FilterByBoolMask(GetKeys(lst3), list_checker(lst[3], code))["in"]),1); }
code_block_5 = CodeBlock(lst3=code_block, lst=readFromFile, code=excel_column_name_for) { List.Flatten(List.GetItemAtIndex(lst3, List.FilterByBoolMask(GetKeys(lst3), list_checker(lst[3], code))["in"]),1); }
code_block_6 = CodeBlock(lst3=code_block, lst=readFromFile, code=excel_column_name_for_drawing) { List.Flatten(List.GetItemAtIndex(lst3, List.FilterByBoolMask(GetKeys(lst3), list_checker(lst[3], code))["in"]),1); }
code_block_7 = CodeBlock(lst3=code_block, lst=readFromFile, code=excel_column_name_for_drawing_2) { List.Flatten(List.GetItemAtIndex(lst3, List.FilterByBoolMask(GetKeys(lst3), list_checker(lst[3], code))["in"]),1); }
code_block_8 = CodeBlock(lst3=code_block, lst=readFromFile, code=excel_column_name_for_floor) { List.Flatten(List.GetItemAtIndex(lst3, List.FilterByBoolMask(GetKeys(lst3), list_checker(lst[3], code))["in"]),1); }
code_block_9 = CodeBlock(lst3=code_block, lst=readFromFile, code=excel_column_for_profession_code) { List.Flatten(List.GetItemAtIndex(lst3, List.FilterByBoolMask(GetKeys(lst3), list_checker(lst[3], code))["in"]),1); }
code_block_10 = CodeBlock(lst3=code_block, lst=readFromFile, code=excel_column_name_for_drawing_3) { List.Flatten(List.GetItemAtIndex(lst3, List.FilterByBoolMask(GetKeys(lst3), list_checker(lst[3], code))["in"]),1); }
code_block_11 = CodeBlock(lst3=code_block, lst=readFromFile, code=excel_column_name_for_drawing_4) { List.Flatten(List.GetItemAtIndex(lst3, List.FilterByBoolMask(GetKeys(lst3), list_checker(lst[3], code))["in"]),1); }

# group: Drawing Size's for filter
code_block_12 = CodeBlock()
# ---------- code_block_12.designscript (6 lines) ----------
//Drawing size checks

"A0";
"A1";
"A2";
"A3";
# ----------------------------------------

codeBlock_4 = CodeBlock(a=python_script) { a[0][2]; a[0][3]; a[0][4]; a[0][5]; }

# group: Sheet Border adder
python_script_2 = Python(IN[0]=code_block_11, IN[1]=code_block_12.out0, IN[2]=code_block_12.out1, IN[3]=code_block_12.out2, IN[4]=code_block_12.out3, IN[5]=codeBlock_4.out0, IN[6]=codeBlock_4.out1, IN[7]=codeBlock_4.out2, IN[8]=codeBlock_4.out3)
# ---------- python_script_2.python (33 lines) ----------
#Created By Brendan Cassidy

import clr
clr.AddReference('ProtoGeometry')
from Autodesk.DesignScript.Geometry import *
#The inputs to this node will be stored as a list in the IN variables.

List_Check=IN[0]

Size_A0=IN[1]
Size_A1=IN[2]
Size_A2=IN[3]
Size_A3=IN[4]

Family_A0=IN[5]
Family_A1=IN[6]
Family_A2=IN[7]
Family_A3=IN[8]

output=[]

for a in List_Check:
	if a == Size_A0:
		output.append(Family_A0)
	elif a == Size_A1:
		output.append(Family_A1)
	elif a == Size_A2:
		output.append(Family_A2)
	elif a == Size_A3:
		output.append(Family_A3)

#Assign your output to the OUT variable.
OUT = output
# ----------------------------------------

# group: List Joiner And Null Removal
code_block_13 = CodeBlock(a=code_block_4, b=code_block_5, c=code_block_6, d=code_block_7, e=code_block_8, f=code_block_9, g=code_block_10, h=code_block_11, i=python_script_2) { List.Transpose({a,b,c,d,e,f,g,h,i}); }
python_script_3 = Python(IN[0]=code_block_13)
# ---------- python_script_3.python (64 lines) ----------
#Created By Brendan Cassidy

#Libraries
import clr
clr.AddReference('ProtoGeometry')
from Autodesk.DesignScript.Geometry import *

clr.AddReference('DSCoreNodes')
import DSCore
from DSCore import *

clr.AddReference('Display')
import Display
from Display import *


#Input
lst=IN[0]

#Counts total number of null elements
temp_output=[]
for a in lst:
	temp_count=0
	for b in a:
		if not b:
			temp_count=(temp_count+1)
	temp_output.append(temp_count)

#Counts total elements in sublist
Total=len(lst[0])

#counts partial null values and
#outputs content with zero null values
null_count=0
output=[]

count=0
for a in lst:
	if 0 < temp_output[count] < Total:
  		count=(count+1)
  		null_count=(null_count+1)
	elif temp_output[count] == 0:
		count=(count+1)
 		output.append(a)
 	else:
 		count=(count+1)


#Warning text output
if null_count == 0:
	Output_text="There were no drawings from the excel sheet that had some elements as null values. Therefore all drawings sheets that was not already in revit have been created in revit."

else:
	Output_text="There are " + str(null_count) + " total drawings from the excel sheet that have some null elements within. Therefore you will need to sort these prior to them being created in revit."


#Cubiod indicator
So=Cuboid.ByLengths(10,10,10)
Eo=So.Edges
Offset=1
Output_Solid=Solid.Fillet(So,Eo,Offset)

#Output
OUT=[output,[Output_text,Output_Solid]]
# ----------------------------------------
code_block_14 = CodeBlock(a=python_script_3) { a[1]; a[0]; }

# group: Sheet Category
categories_2 = Categories("Sheets")
all_elements_of_category_2 = ElementsOfCategory(categories_2)
sheetNumber = Sheet.SheetNumber(all_elements_of_category_2)

codeBlock_5 = CodeBlock(a=python_script)
# ---------- codeBlock_5.designscript (6 lines) ----------
{a[0][7],
a[0][8],
a[0][9],
a[0][10],
a[0][11],
a[0][12]};
# ----------------------------------------
string_from_object = FromObject(codeBlock_5)
seporator = CodeBlock { "-"; }

# group: Drawing Name Joiner
transpose = List.Transpose(code_block_14.out1)
create_independant_lists = CodeBlock(list=transpose) { {list[3],list[4],list[2],list[5],list[1],list[0]}; list[6]; list[7]; list[8]; }
python_script_4 = Python(IN[0]=create_independant_lists.out0, IN[1]=string_from_object, IN[2]=seporator)
# ---------- python_script_4.python (23 lines) ----------
#Created By Brendan Cassidy

#Input
Arrangement=[IN[1]]
Text_input=zip(*IN[0])
output=[]

#Joins list input and specified arrangement list

list_Join=zip(*Arrangement + Text_input)

#Sorts and transposes list
Text_rearrange=zip(*sorted(list_Join, key=lambda list_Join:(list_Join[0])))

Text_Seporator=IN[2]
	
#Joins each sub code together
for a in Text_rearrange:
	Temp_Output=str(a[0]) + Text_Seporator + str(a[1]) + Text_Seporator + str(a[2]) + Text_Seporator + str(a[3]) + Text_Seporator + str(a[4]) + Text_Seporator + str(a[5])
	output.append(Temp_Output)

#Output
OUT=output[1:]
# ----------------------------------------

codeBlock_6 = CodeBlock(a=python_script, b=download_uk_dynamo_group_image) { {a[1],b}; }
codeBlock_7 = CodeBlock(a=codeBlock_6) { a[0]; a[1]; }
codeBlock_8 = CodeBlock(a=python_script) { a[0][6]; }

# group: Revit Sheet Parameter
sheet_size_parameter_name = StringInput("Sheet Size")

# group: Filter Out Existing Sheets And Sheet Creator
code_block_15 = CodeBlock(Sheetnumber=sheetNumber, a=python_script_4, b=create_independant_lists.out1, c=create_independant_lists.out3, d=create_independant_lists.out2)
# ---------- code_block_15.designscript (7 lines) ----------
lst=List.ContainsItem(Sheetnumber,a);
lst1=List.FilterByBoolMask(List.Transpose({a,b,c,d}),lst)["out"];
lst2=List.Transpose(lst1);
lst2[0];
lst2[1];
lst2[2];
lst2[3];
# ----------------------------------------
byNameNumberTitleBlockAndView = Sheet.ByNameNumberTitleBlockAndView(sheetName=code_block_15.out4, sheetNumber=code_block_15.out3, titleBlockFamilyType=code_block_15.out5, view=codeBlock_8)
setParameterByName_3 = Element.SetParameterByName(element=byNameNumberTitleBlockAndView, parameterName=sheet_size_parameter_name, value=code_block_15.out6)

# group: Error Indicator Checker
python_script_5 = Python(IN[0]=code_block_14.out0, IN[1]=code_block_15.lst1)
# ---------- python_script_5.python (45 lines) ----------
#Created By Brendan Cassidy

#Libraries
import clr
clr.AddReference('ProtoGeometry')
from Autodesk.DesignScript.Geometry import *

clr.AddReference('DSCoreNodes')
import DSCore
from DSCore import *

clr.AddReference('Display')
import Display
from Display import *

#Input
Error_text=IN[0][0]
Error_geometry=IN[0][1]

Error_check_text="There were no drawings from the excel sheet that had some elements as null values. Therefore all drawings sheets that was not already in revit have been created in revit."

lst=IN[1]



#Warning text output
if not lst:
	Output_text="There are no drawing sheets to process"
	Output_Color=Color.ByARGB(255, 250, 0, 0)
else:
	if Error_text == Error_check_text:
		Output_text=Error_text
		Output_Color=Color.ByARGB(255, 0, 250, 050)
	else:
		Output_text=Error_text
		Output_Color=Color.ByARGB(255, 250, 130, 050)

#Cubiod indicator


OSC=Display.ByGeometryColor(Error_geometry,Output_Color)

#OUT=temp_output
#Output
OUT=[Output_text,OSC]
# ----------------------------------------
code_block_16 = CodeBlock(a=python_script_5) { a[0]; }

# group: Error Indicator
watch = Watch(code_block_16)

# group: Error Report UI
string = StringInput("Error Report")
# note: From Data-Shapes package
ui_textnote_data = Python(IN[0]=string, IN[1]=code_block_16)
# ---------- ui_textnote_data.python (19 lines) ----------
#Copyright (c) mostafa el ayoubi ,  2016
#Data-Shapes www.data-shapes.net , elayoubi.mostafa@gmail.com

class uitextnote():

    def __init__(self,inputname, title, textnote):
        self.inputname = inputname
        self.title = title
        self.textnote = textnote



    def __repr__(self):
        return 'UI.TextNote input'
        
x = uitextnote("",IN[0],IN[1])


OUT = x
# ----------------------------------------
string_2 = StringInput("Ok")
code_block_17 = CodeBlock { true; null; ""; 0; 350; }
multipleInputForm = Python(IN[0]=ui_textnote_data, IN[1]=string_2, IN[2]=code_block_17.out0, IN[3]=code_block_17.out2, IN[4]=codeBlock_7.out1, IN[5]=code_block_17.out1, IN[6]=code_block_17.out1, IN[7]=code_block_17.out3, IN[8]=code_block_17.out4, IN[9]=setParameterByName_3)  # "UI.MultipleInputForm"
# ---------- multipleInputForm.python (883 lines) ----------
#Copyright (c) mostafa el ayoubi ,  2016
#Data-Shapes www.data-shapes.net , elayoubi.mostafa@gmail.com
	
	
import clr
try:
	clr.AddReference('System.Windows.Forms')
	clr.AddReference('System.Drawing')
	
	from System.Drawing import Point , Size , Graphics, Bitmap, Image, Font, FontStyle, Icon, Color, Region , Rectangle 
	from System.Windows.Forms import Application, DockStyle, Button, Form, Label, TrackBar , ToolTip, ColumnHeader, TextBox, CheckBox, FolderBrowserDialog, OpenFileDialog, DialogResult, ComboBox, FormBorderStyle, FormStartPosition, ListView, ListViewItem , SortOrder, Panel, ImageLayout, GroupBox, RadioButton, BorderStyle, PictureBox, PictureBoxSizeMode, LinkLabel, CheckState, ColumnHeaderStyle , ImageList, VScrollBar
	from System.Collections.Generic import *
	from System.Collections.Generic import List as iList
	from System.Windows.Forms import View as vi
	clr.AddReference('System')
	from System import IntPtr
	from System.ComponentModel import Container
	
	
	import sys
	pyt_path = r'C:\Program Files (x86)\IronPython 2.7\Lib'
	sys.path.append(pyt_path)
	import os
	import webbrowser
	import unicodedata
	
	clr.AddReference('RevitAPIUI')
	from  Autodesk.Revit.UI import Selection , TaskDialog
	from  Autodesk.Revit.UI.Selection import ISelectionFilter
	
	importcolorselection = 0
	
	try:
		from  Autodesk.Revit.UI import ColorSelectionDialog
	except:
		importcolorselection = 1
	
	clr.AddReference('RevitNodes')
	import Revit
	clr.ImportExtensions(Revit.Elements)
	clr.ImportExtensions(Revit.GeometryConversion)
	
	clr.AddReference('RevitServices')
	from RevitServices.Persistence import DocumentManager
	doc = DocumentManager.Instance.CurrentDBDocument
	uidoc = DocumentManager.Instance.CurrentUIApplication.ActiveUIDocument

	clr.AddReference('RevitAPI')
	from Autodesk.Revit.DB import FilteredElementCollector , View , ViewType , ElementId , FamilyInstance
	dbviews = [v for v in FilteredElementCollector(doc).OfClass(View).ToElements() if (v.ViewType == ViewType.FloorPlan or v.ViewType == ViewType.CeilingPlan or v.ViewType == ViewType.Section or v.ViewType == ViewType.Elevation or v.ViewType == ViewType.ThreeD)]
	viewindex = 0

	
	from System.Reflection import Assembly
	import xml.etree.ElementTree as et

	class selectionfilter(ISelectionFilter):
		def __init__(self,category):
			self.category = category
		def AllowElement(self,element):
			if element.Category.Name in [c.Name for c in self.category]:
				return True
			else:
				return False
		def AllowReference(reference,point):
			return False
	
	class MultiTextBoxForm(Form):
		
	    def __init__(self):
	        self.Text = 'Excel to revit Sheet Report'
	        self.output = []
	        self.values = []
	        self.cancelled = False
	
	    def setclose(self, sender, event):
	    	cbindexread = 0
	    	if sender.Name != "Cancel":
	    		for f in self.output:
	    			if f.GetType() == TextBox:
	    				self.values.append(f.Text)
	    			if f.GetType() == CheckBox:
	    				self.values.append(f.Checked)
	    			if f.GetType() == Button:
	    				if isinstance(f.Tag ,list):
	    					self.values.append([e for e in f.Tag if e.__class__.__name__ != "Category"])
	    				else:	    					
	    					if f.Tag.__class__.__name__ != "Category":
	    						self.values.append(f.Tag)
	    					else:
    							self.values.append([])

	    			if f.GetType() == ComboBox:
	    				try:
	    					key = f.Text
	    					self.values.append(f.Tag[key])
	    				except:
	    					self.values.append(None)
	    			if f.GetType() == mylistview:
	    				self.values.append([f.Values[i.Text] for i in f.CheckedItems])
	    			if f.GetType() == mytrackbar:
	    				self.values.append(f.startval+f.Value*f.step)
	    			if f.GetType() == mygroupbox:
	    				try:
	    					key = [j.Text for j in f.Controls if j.Checked == True][0]
	    					self.values.append(f.Tag[key])
	    				except:
	    					self.values.append(None)
	    	else:
	    		self.values = None
	    		self.cancelled = True
	    	self.Close()
	
	    def reset(self, sender, event):
			pass
	
	    def openfile(self, sender, event):
			ofd = OpenFileDialog()
			dr = ofd.ShowDialog()
			if dr == DialogResult.OK:
				sender.Text = ofd.FileName
				sender.Tag = ofd.FileName
	
	    def opendirectory(self, sender, event):
			fbd = FolderBrowserDialog()
			fbd.SelectedPath = sender.Text
			dr = fbd.ShowDialog()
			if dr == DialogResult.OK:
				sender.Text = fbd.SelectedPath
				sender.Tag = fbd.SelectedPath
	
	    def pickobjects(self, sender, event):
			for c in self.Controls:
				c.Enabled = False
			sel = uidoc.Selection.PickObjects(Selection.ObjectType.Element,'')
			selelem = [doc.GetElement(s.ElementId) for s in sel]
			sender.Tag = (selelem)
			for c in self.Controls:
				c.Enabled = True
			
	    def picklinkedobjects(self, sender, event):
			#This part was made easier by Dimitar Venkov's work
			for c in self.Controls:
				c.Enabled = False
			linkref = uidoc.Selection.PickObject(Selection.ObjectType.Element,'Select the link instance.')
			link = doc.GetElement(linkref.ElementId).GetLinkDocument()
			td = TaskDialog.Show('Data-Shapes','Select the linked elements and press Finish.')
			sel = uidoc.Selection.PickObjects(Selection.ObjectType.LinkedElement,'Select the linked elements and press Finish.')
			selelem = [link.GetElement(s.LinkedElementId) for s in sel]
			sender.Tag = (selelem)
			for c in self.Controls:
				c.Enabled = True		

	    def pickobject(self, sender, event):
			for c in self.Controls:
				c.Enabled = False
			sel = uidoc.Selection.PickObject(Selection.ObjectType.Element,'')
			selelem = doc.GetElement(sel.ElementId) 
			sender.Tag = (selelem)
			for c in self.Controls:
				c.Enabled = True
			
	    def picklinkedobject(self, sender, event):
			#This part was made easier by Dimitar Venkov's work
			for c in self.Controls:
				c.Enabled = False
			linkref = uidoc.Selection.PickObject(Selection.ObjectType.Element,'Select the link instance.')
			link = doc.GetElement(linkref.ElementId).GetLinkDocument()
			td = TaskDialog.Show('Data-Shapes','Select the linked element.')
			sel = uidoc.Selection.PickObject(Selection.ObjectType.LinkedElement,'Select the linked element.')
			selelem = link.GetElement(sel.LinkedElementId)
			sender.Tag = (selelem)
			for c in self.Controls:
				c.Enabled = True
			
	    def pickobjectsofcat(self, sender, event):
			for c in self.Controls:
				c.Enabled = False
			if isinstance(sender.Tag,list):	    
				category = UnwrapElement(sender.Tag)
			else:
				category = [UnwrapElement(sender.Tag)]
			selfilt = selectionfilter(category)
			sel = uidoc.Selection.PickObjects(Selection.ObjectType.Element,selfilt,'Select %s' %(', '.join([c.Name for c in category])))
			selelem = [doc.GetElement(s.ElementId) for s in sel]
			sender.Tag = (selelem)
			for c in self.Controls:
				c.Enabled = True

	    def pickobjectofcat(self, sender, event):
			for c in self.Controls:
				c.Enabled = False
			if isinstance(sender.Tag,list):	    
				category = UnwrapElement(sender.Tag)
			else:
				category = [UnwrapElement(sender.Tag)]
			selfilt = selectionfilter(category)
			sel = uidoc.Selection.PickObject(Selection.ObjectType.Element,selfilt,'Select %s' %(', '.join([c.Name for c in category])))
			selelem = doc.GetElement(sel.ElementId) 
			sender.Tag = (selelem)
			for c in self.Controls:
				c.Enabled = True
			
	    def pickfaces(self, sender, event):
			for c in self.Controls:
				c.Enabled = False
			selface = uidoc.Selection.PickObjects(Selection.ObjectType.Face,'')
			faces = [uidoc.Document.GetElement(s).GetGeometryObjectFromReference(s).ToProtoType(True) for s in selface]
			sender.Tag = [i for f in faces for i in f]
			for c in self.Controls:
				c.Enabled = True
				
	    def pickedges(self, sender, event):
			for c in self.Controls:
				c.Enabled = False
			seledge = uidoc.Selection.PickObjects(Selection.ObjectType.Edge,'')
			edges = [uidoc.Document.GetElement(s).GetGeometryObjectFromReference(s).AsCurve().ToProtoType(True) for s in seledge]
			sender.Tag = edges
			for c in self.Controls:
				c.Enabled = True

	    def colorpicker(self, sender, event):
			dialog = ColorSelectionDialog()
			selection = ColorSelectionDialog.Show(dialog)
			selected = dialog.SelectedColor
			sender.Tag = selected
			sender.BackColor = Color.FromArgb(selected.Red,selected.Green,selected.Blue)
			sender.ForeColor = Color.FromArgb(selected.Red,selected.Green,selected.Blue)
	
	    def topmost(self):
			self.TopMost = True
	
	    def lvadd(self, sender, event):
			sender.Tag = [i for i in sender.CheckedItems]
			
	    def scroll(self, sender, event):
			parent = sender.Parent
			child = parent.GetChildAtPoint(Point(0,5))
			child.Text = str(sender.startval+sender.Value*sender.step)

	    def openurl(self, sender, event):
			webbrowser.open(sender.Tag)
	
	    def selectall(self, sender, event):
			if sender.Checked:
				parent = sender.Parent
				listview = parent.GetChildAtPoint(Point(0,0))
				for i in listview.Items:
					i.Checked = True
			else:
				pass
				
	    def selectnone(self, sender, event):
			if sender.Checked:
				parent = sender.Parent
				listview = parent.GetChildAtPoint(Point(0,0))
				for i in listview.Items:
					i.Checked = False
			else:
				pass		

	    def updateallnone(self, sender, event):
	    	try:
	    		parent = sender.Parent
	    		rball = parent.GetChildAtPoint(Point(0,sender.Height + 5))
	    		rbnone = parent.GetChildAtPoint(Point(80,sender.Height + 5))
	    		if sender.CheckedItems.Count == 0 and event.NewValue == CheckState.Unchecked:
	    			rbnone.Checked = False
	    			rball.Checked = False
	    		elif sender.CheckedItems.Count == sender.Items.Count and event.NewValue == CheckState.Unchecked:
	    			rball.Checked = False
	    			rbnone.Checked = False
	    		elif sender.CheckedItems.Count == sender.Items.Count-1 and event.NewValue == CheckState.Checked:
	    			rball.Checked = True
	    			rbnone.Checked = False
	    		elif sender.CheckedItems.Count == 1 and event.NewValue == CheckState.Unchecked:
	    			rball.Checked = False
	    			rbnone.Checked = True	    	
	    		else :
	    			rball.Checked = False
	    			rbnone.Checked = False
	    	except:
	    		pass

	    def zoomcenter(self, sender, event ):
			if event.X > 15:	    
				try:
					uiviews = uidoc.GetOpenUIViews()
					element = doc.GetElement(uidoc.Selection.GetElementIds()[0])
					activeview = doc.ActiveView
					bbox = element.get_BoundingBox(activeview)	
					activeuiview = [v for v in uiviews if v.ViewId == activeview.Id][0]
					activeuiview.ZoomAndCenterRectangle(bbox.Min, bbox.Max)
					uidoc.RefreshActiveView()
				except:
					pass
			else:
				pass
				
			
	    def setviewforelement(self, sender, event ):    
			if event.X > 15:	    		
				try:
					item = sender.GetItemAt(event.X,event.Y).Text
					element = UnwrapElement(sender.Values[item])
					try:
						viewsforelement = [v for v in dbviews if (not v.IsTemplate) and (element.Id in [e.Id for e in FilteredElementCollector(doc,v.Id).OfClass(element.__class__).ToElements()])]
					except:
						viewsforelement = [v for v in dbviews if (not v.IsTemplate) and (element.Id in [e.Id for e in FilteredElementCollector(doc,v.Id).OfClass(FamilyInstance).ToElements()])]
					global viewindex
					dbView = viewsforelement[viewindex]
					id = [element.Id]
					icollection = iList[ElementId](id)
					uidoc.Selection.SetElementIds(icollection)
					if (viewindex >= len(viewsforelement) -1) or not (element.Id in uidoc.Selection.GetElementIds()):
						viewindex = 0
					else:
						viewindex += 1
					uidoc.RequestViewChange(dbView)
				except:
					pass
			else:	    
				pass
				
			
			


	class mylistview(ListView):
	
		def __init__(self):
			self.Values = []

	class mytrackbar(TrackBar):
	
		def __init__(self,startval,step):
			self.startval = startval
			self.step = step
			
	class mygroupbox(GroupBox):
	
		def __init__(self):
			self.Values = []
	
	#Form initialization
	
	form = MultiTextBoxForm()
	form.topmost()	
	form.ControlBox = False
	xlabel = 25
	xinput = 150
	formy = 10
	if IN[8] > 350:	formwidth = IN[8]
	else: formwidth = 350
	fields = []
	error = 0
	
	#Description 
	
	if IN[3] != "":
		des = Label()
		des.Font = Font("Arial", 15,FontStyle.Bold)
		des.Location = Point(xlabel,formy)
		des.AutoSize = True
		des.MaximumSize = Size(formwidth - 2 * xlabel,0)
		des.Text = IN[3]
		form.Controls.Add(des)
		formy = des.Bottom + 15
	formheaderheight = formy
	
	#Input form
	
	# Create a container panel for all inputs
	body = Panel()
	body.Location = Point(0,formy)
	body.Width = formwidth - 15
	
	
	# Process form inputs
	if isinstance(IN[0],list):
		inputtypes = IN[0]
	else:
		inputtypes = [IN[0]]
	# This definition is to handle the sorting of special characters
	def remove_accents(input_str):
	    nfkd_form = unicodedata.normalize('NFKD', input_str)
	    only_ascii = nfkd_form.encode('ASCII', 'ignore')
	    return only_ascii	

	
	def addinput(formbody,inputs,starty,xinput,rightmargin,labelsize,importcolorselection):
		y = starty
		for j in inputs:
			label = Label()
			label.Location = Point(xlabel,y+4)
			label.AutoSize = True
			label.MaximumSize = Size(labelsize,0)
			if j.__class__.__name__ == 'listview' and j.element_count > 0:
				label.Text = j.inputname + '\n(' + str(j.element_count) + ' element' + ("s" if j.element_count > 1 else "") + ')'
			else:
				label.Text = j.inputname
			formbody.Controls.Add(label)
	
			if j.__class__.__name__ == 'dropdown':
				cb = ComboBox()
				cb.Location = Point(xinput,y)
				cb.Width = formwidth - xinput - rightmargin
				cb.Sorted = True
				[cb.Items.Add(i) for i in j.keys() if not (i == 'inputname' or i == 'height' or i == 'defaultvalue' or i == 'highlight')]
				cb.Tag = j
				if j.defaultvalue != None:
					defindex = [i for i in cb.Items].index([i for i in j.keys() if not (i == 'inputname' or i == 'height' or i == 'defaultvalue' or i == 'highlight')][j.defaultvalue])
					cb.SelectedIndex = defindex
				formbody.Controls.Add(cb)
				form.output.append(cb)
				y = label.Bottom + 25
			elif j.__class__.__name__ == 'listview':
				lvp = Panel()
				lvp.Location = Point(xinput,y)
				lvp.Height = j.height + 25
				lvp.Width = formwidth - xinput - rightmargin
				#Creating the listview box
				lv = mylistview()
				lv.Scrollable = True
				dummyheader = ColumnHeader()
				dummyheader.Text = ""
				dummyheader.Name = ""
				dummyheader.Width = -2
				lv.HeaderStyle = ColumnHeaderStyle.None
				lv.Columns.Add(dummyheader)
				lv.Values = j
				if not j.display_mode:
					lv.CheckBoxes = True
				lv.View = vi.Details
				lvItems =  [i for i in j.keys() if not (i == 'inputname' or i == 'height' or i == 'highlight' or i == 'display_mode' or i == 'element_count' or i == 'default_values' or i == 'sorted')]
				if j.sorted :
					lvItems = sorted(lvItems,key = remove_accents)
				else:
					pass
				[lv.Items.Add(i) for i in lvItems]
				lv.Location = Point(0,0)
				lv.Width = formwidth - xinput - rightmargin
				lv.Height = j.height
				lv.Scrollable = True
				lv.ItemCheck += form.updateallnone
				for i in j.default_values:
					defInd = lvItems.index([x for x in j.keys() if not (x == 'inputname' or x == 'height' or x == 'highlight' or x == 'display_mode' or x == 'element_count' or x == 'default_values' or x == 'sorted')][i])
					lv.Items[defInd].Checked = True
				#Click listview items to hilight and center in appropriate view
				if j.highlight :
					lv.MouseDown += form.setviewforelement
					lv.MouseUp += form.zoomcenter
					items = list(lv.Items)
					lv.FullRowSelect = True
					del items[::2]
					for item in items:
						item.BackColor = Color.FromArgb(230,243,255)
				#Creating select all and select none radiobuttons
				if not j.display_mode:
					rball = RadioButton()
					rball.Location = Point(0,(j.height)+5)
					rball.Width = 70
					rball.Text = "Select all"
					rball.Click += form.selectall
					rbnone = RadioButton()
					rbnone.Location = Point(80,(j.height)+5)
					rbnone.Width = 90
					rbnone.Text = "Select none"			
					rbnone.Click += form.selectnone			
				#Adding controls to panel
				lvp.Controls.Add(lv)
				if not j.display_mode:
					lvp.Controls.Add(rball)
					lvp.Controls.Add(rbnone)
				formbody.Controls.Add(lvp)
				if not j.display_mode:
					form.output.append(lv)
				y = lvp.Bottom + 25
			elif j.__class__.__name__ == 'uitext':
				tb = TextBox()
				tb.Text = j.defaultvalue
				tb.Width = formwidth - xinput - rightmargin
				tb.Location = Point(xinput,y)
				formbody.Controls.Add(tb)
				formbody.Controls.Add(label)
				form.output.append(tb)
				y = label.Bottom + 25
			elif j.__class__.__name__ == 'uitextnote':
				gb = GroupBox()
				gb.Text = j.title
				gb.Parent = form
				gb.SendToBack()
				gb.BackColor = Color.Transparent
				gb.Location = Point(xlabel, y)
				tn = Label()
				tn.Location = Point(xlabel,18)
				tn.AutoSize = True
				tn.MaximumSize = Size(formwidth - 90,0)
				tn.Text = j.textnote
				tn.BringToFront()
				gb.Controls.Add(tn)
				gb.Size = Size(formwidth - 65, tn.Bottom-tn.Top+25)
				y = gb.Bottom + 25
				formbody.Controls.Add(gb)
			elif j.__class__.__name__ == 'uibool':
				yn = CheckBox()
				yn.Width = formwidth - xinput - 50
				yn.Location = Point(xinput,y)
				yn.Text = j.booltext
				g = yn.CreateGraphics()
				sizetext = g.MeasureString(yn.Text,yn.Font, formwidth - xinput - 70)
				heighttext = sizetext.Height
				yn.Height = heighttext + 15
				yn.Checked = j.defaultvalue
				formbody.Controls.Add(yn)
				form.output.append(yn)
				y = yn.Bottom + 25
			elif j.__class__.__name__ == 'uiradio':
				yrb = 20
				rbs = []
				rbgroup = mygroupbox()
				rbgroup.Width = formwidth - xinput - rightmargin
				rbgroup.Location = Point(xinput,y)
				rbgroup.Tag = j
				rbcounter = 0
				for key in j.keys():
					if key != 'inputname' and key != 'defaultvalue':
						rb = RadioButton()
						rb.Text = key 
						rb.Width = formwidth - xinput - rightmargin - 30
						rb.Location = Point(20,yrb)
						if rbcounter == j.defaultvalue:
							rb.Checked = True
						rbgroup.Controls.Add(rb)
						g = rb.CreateGraphics()
						sizetext = g.MeasureString(key,rb.Font, formwidth - xinput - 70)
						heighttext = sizetext.Height
						rb.Height = heighttext + 15
						ybot = rb.Bottom
						yrb += heighttext + 12
						rbcounter += 1
					else:
						pass
				rbgroup.Height = ybot +20
				[rbgroup.Controls.Add(rb) for rb in rbs]
				formbody.Controls.Add(rbgroup)
				form.output.append(rbgroup)
				y = rbgroup.Bottom + 25
			elif j.__class__.__name__  == 'uifilepath':
				fp = Button()
				fp.Width = formwidth - xinput - rightmargin
				fp.Tag = j.defaultvalue
				if j.defaultvalue == "FilePath":
					fp.Text = j.buttontext
				else:
					fp.Text = j.defaultvalue
				fp.Location = Point(xinput,y)
				formbody.Controls.Add(fp)
				fp.Click += form.openfile
				form.output.append(fp)
				y = label.Bottom + 25
			elif j.__class__.__name__ == 'uidirectorypath':
				dp = Button()
				dp.Width = formwidth - xinput - rightmargin
				dp.Tag = j.defaultvalue
				if j.defaultvalue == "DirectoryPath":
					dp.Text = j.buttontext
				else:
					dp.Text = j.defaultvalue
				dp.Location = Point(xinput,y)
				formbody.Controls.Add(dp)
				dp.Click += form.opendirectory
				form.output.append(dp)
				y = label.Bottom + 30
			elif j.__class__.__name__ == 'uiselectelements':
				se = Button()
				se.Width = formwidth - xinput - rightmargin
				se.Text = j.buttontext
				se.Location = Point(xinput,y)
				formbody.Controls.Add(se)
				if j.multi == False:
					se.Click += form.pickobjects
				else:
					se.Click  += form.pickobject
				form.output.append(se)
				y = label.Bottom + 25
			elif j.__class__.__name__ == 'uiselectlinkedelements':
				se = Button()
				se.Width = formwidth - xinput - rightmargin
				se.Text = j.buttontext
				se.Location = Point(xinput,y)
				formbody.Controls.Add(se)
				if j.multi == False:
					se.Click += form.picklinkedobjects
				else:
					se.Click  += form.picklinkedobject
				form.output.append(se)
				y = label.Bottom + 25
			elif j.__class__.__name__ == 'uiselectlinkedelementsofcat':
				sec = Button()
				sec.Width = formwidth - xinput - rightmargin
				sec.Text = j.buttontext
				sec.Tag = j.category
				sec.Location = Point(xinput,y)
				formbody.Controls.Add(sec)
				if j.multi == False:
					sec.Click += form.picklinkedobjectsofcat
				else:
					sec.Click += form.picklinkedobjectofcat
				form.output.append(sec)
				y = label.Bottom + 25
			elif j.__class__.__name__ == 'uiselectelementsofcat':
				sec = Button()
				sec.Width = formwidth - xinput - rightmargin
				sec.Text = j.buttontext
				sec.Tag = j.category
				sec.Location = Point(xinput,y)
				formbody.Controls.Add(sec)
				if j.multi == False:
					sec.Click += form.pickobjectsofcat
				else:
					sec.Click += form.pickobjectofcat
				form.output.append(sec)
				y = label.Bottom + 25
			elif j.__class__.__name__ == 'uiselectfaces':
				sf = Button()
				sf.Width = formwidth - xinput - rightmargin
				sf.Text = j.buttontext
				sf.Location = Point(xinput,y)
				formbody.Controls.Add(sf)
				sf.Click += form.pickfaces
				form.output.append(sf)
				y = label.Bottom + 25
			elif j.__class__.__name__ == 'uiselectedges':
				sed = Button()
				sed.Width = formwidth - xinput - rightmargin
				sed.Text = j.buttontext
				sed.Location = Point(xinput,y)
				formbody.Controls.Add(sed)
				sed.Click += form.pickedges
				form.output.append(sed)
				y = label.Bottom + 25
				
			elif j.__class__.__name__ == 'uislider':
				gb = Panel()
				if j.defaultvalue == '':
					defval = j.minimum
				else:
					defval = j.defaultvalue
				sl = mytrackbar(j.minimum,j.step)
				gb.Width = formwidth - xinput - rightmargin
				gb.Height = 40
				sl.Minimum = 0
				sl.Maximum = (j.maximum-j.minimum)/j.step
				sl.Value = (defval - j.minimum) / j.step
				sl.TickFrequency = (j.maximum-j.minimum)/j.step/10
				gb.Location = Point(xinput,y)
				sl.Location = Point(40,0)
				sl.Width = formwidth - xinput - 75
				gb.Controls.Add(sl)
				form.output.append(sl)
				displabel = Label()
				displabel.Width = 50
				displabel.Location = Point(0,5)
				displabel.Text = str(defval)
				displabel.BringToFront()
				gb.Controls.Add(displabel)	
				formbody.Controls.Add(gb)			
				sl.Scroll += form.scroll
				y = label.Bottom + 25
			elif j.__class__.__name__ == 'uiimage':
				pic = Image.FromFile(j.image)
				im = PictureBox()
				if j.showborder:
					im.BorderStyle = BorderStyle.Fixed3D
				else:
					im.BorderStyle = BorderStyle.None
				ratio = (pic.Height)/(pic.Width)
				h = float(pic.Height)
				w = float(pic.Width)
				ratio = h/w
				image_maxsize = formwidth - xlabel - rightmargin
				im.Size = Size(image_maxsize,image_maxsize*ratio)
				scaledimage = Bitmap(image_maxsize,image_maxsize*ratio)
				gr = Graphics.FromImage(scaledimage)
				gr.DrawImage(pic,0,0,image_maxsize,image_maxsize*ratio)
				im.Image = pic
				im.SizeMode = PictureBoxSizeMode.Zoom
				formbody.Controls.Add(im)
				im.Location = Point(25,y+25)
				y = im.Bottom + 25
		
			elif j.__class__.__name__ == 'uicolorpick' and importcolorselection == 0:
				cp = Button()
				cp.Width = formwidth - xinput - rightmargin
				cp.Text = j.buttontext
				cp.Location = Point(xinput,y)
				formbody.Controls.Add(cp)
				cp.Click += form.colorpicker
				form.output.append(cp)
				y = label.Bottom + 25			
			elif j.__class__.__name__ == 'uicolorpick' and importcolorselection == 1:
				importcolorselection = 2
			elif j.__class__.__name__ == 'uigroup':
				grouppanel = GroupBox()
				grouppanel.Text = j.groupname
				grouppanel.Location = Point(xlabel,y)
				grouppanel.Width = formwidth - 65
				#recursive implementation of the definition to process grouped inputs
				addinput(grouppanel,j.inputgroup,25,xinput-25,80,90,importcolorselection)
				formbody.Controls.Add(grouppanel)
				y = grouppanel.Bottom + 25
			formbody.Height = y



	# process input lists 
	addinput(body,inputtypes,0,xinput,40,120,importcolorselection)
	
	#add the formbody panel to the form
	form.Controls.Add(body)		
	
	#Adding Logo 
	#default logo in case no input	
	try:
		if IN[4] != '':
			try:
				ima = Image.FromFile(IN[4])
				bmp = Bitmap.FromFile(IN[4])
			except:
				ima = IN[4]
				bmp = IN[4]

		else :
			dynamo = Assembly.Load('DynamoCore')
			version = str(dynamo.GetName().Version)[:3]		
			dynPath = os.getenv('APPDATA')+"\\Dynamo\Dynamo Revit\\" + version 
			root = et.parse(dynPath + "\DynamoSettings.xml").getroot()
			logopaths = []
			for child in root:
				if child.tag == "CustomPackageFolders":
					for path in child:
						logopaths.append(path.text + "\packages\Data-Shapes\extra\\a.png")
						logopaths.append(path.text + "\Data-Shapes\extra\\a.png")
			deflogopath = ""
			for path in logopaths:
				if deflogopath == "":
					if os.path.isfile(path):
						deflogopath = path
						try:
							ima = Image.FromFile(deflogopath)
							bmp = Bitmap.FromFile(deflogopath)
						except: 
							pass
		logo = Panel()
		if IN[6] == None:
			xlogo = 20
			ylogo = formy+10
		else:
			xlogo = 30
			ylogo = formy
		size = 110
		logo = PictureBox()
		ratio = (ima.Height)/(ima.Width)
		h = float(ima.Height)
		w = float(ima.Width)
		ratio = h/w
		logo.Size = Size(size,size*ratio)
		scaledimage = Bitmap(size,size*ratio)
		gr = Graphics.FromImage(scaledimage)
		gr.DrawImage(ima,0,0,size,size*ratio)
		logo.Image = ima
		logo.SizeMode = PictureBoxSizeMode.Zoom
		form.Controls.Add(logo)
		logo.Location = Point(xlogo,ylogo)
		#Setting icon 
		thumb = bmp.GetThumbnailImage(64, 64, bmp.GetThumbnailImageAbort,IntPtr.Zero)
		thumb.MakeTransparent();
		icon = Icon.FromHandle(thumb.GetHicon())
		form.Icon = icon

	except :
		pass
	if IN[6] != None:
		if IN[8] > 400:
			formy += 50
			xinput = 270
		else:
			formy = logo.Bottom + 20
	else:
		formy += 50



	#Adding validation button
	
	button = Button()
	button.Text = IN[1]
	button.Width = formwidth - xinput - 40
	button.Location = Point (xinput,formy)
	button.Click += form.setclose
	form.Controls.Add(button)
	form.MaximizeBox = False
	form.MinimizeBox = False
	form.FormBorderStyle = FormBorderStyle.FixedSingle
	
	#Adding Cancel button
	if IN[6] != None:
		cancelbutton = Button()
		cancelbutton.Text = IN[6]
		cancelbutton.Width = 120
		cancelbutton.Name = "Cancel"
		cancelbutton.Location = Point (xinput -120 ,formy)
		cancelbutton.Click += form.setclose
		form.Controls.Add(cancelbutton)
		form.CancelButton = cancelbutton
	
	#Adding link to help
	
	if IN[5] != None :
		helplink = LinkLabel()
		helplink.Text = "Help"
		helplink.Tag = IN[5]
		helplink.Click += form.openurl
		helplink.Location = Point(formwidth - 65,formy+30)
		form.Controls.Add(helplink)
	else:
		pass	
			
	form.ShowIcon = True
	form.Width = formwidth
	form.Height = formy + 120
	formfooterheight = form.Height - formheaderheight
	
	# Make formbody scrollable
	
	# if the form is longer than its maximum height, do the following:
	# modify the form height
	# make the formbody panel scrollable
	if form.Height + body.Height > IN[7] and IN[7] > 0:
		formbody_calculatedheight = IN[7] - form.Height
		# make sure the formbody is at least 100 px high
		if formbody_calculatedheight < 100: formbody_calculatedheight = 100
		body.Height = formbody_calculatedheight
		form.Height = form.Height + formbody_calculatedheight
		# this (and apparently only this) will implement a vertical AutoScroll *only*
		# http://stackoverflow.com/a/28583501
		body.HorizontalScroll.Maximum = 0
		body.AutoScroll = False
		body.VerticalScroll.Visible = False
		body.AutoScroll = True
		body.BorderStyle = BorderStyle.Fixed3D
	else:
		form.Height = form.Height + body.Height
	# Move footer elements
	logo.Location = Point(logo.Location.X, logo.Location.Y + body.Height)
	button.Location = Point(button.Location.X, button.Location.Y + body.Height)
	if IN[6] != None: cancelbutton.Location = Point(cancelbutton.Location.X, cancelbutton.Location.Y + body.Height)
	if IN[5] != None: helplink.Location = Point(helplink.Location.X, helplink.Location.Y + body.Height)

	#Positionning the form at top left of current view
	uiviews = uidoc.GetOpenUIViews()
	if doc.ActiveView.IsValidType(doc.ActiveView.GetTypeId()):
		activeviewid = doc.ActiveView.Id
		activeUIView = [v for v in uiviews if v.ViewId == activeviewid][0]
	else:
		activeUIView = uiviews[0]
	rect = activeUIView.GetWindowRectangle()
	form.StartPosition = FormStartPosition.Manual
	form.Location = Point(rect.Left-7,rect.Top)
		
	if IN[2]:
		if importcolorselection != 2:
			Application.Run(form)
			result = form.values
			OUT = result,True, form.cancelled
		else:
			OUT = ['ColorSelection input is only available With Revit 2017'] , False, False
	else :
		OUT = ['Set toggle to true!'] , False, False
except:
	import traceback
	OUT = traceback.format_exc() , "error", "error"
# ----------------------------------------
