# Dynamo graph Sheet Creation From Excel.dyn (Dynamo 1.3.2.2480)

# note: DYNAMO FILE NAME
# Sheet Creation From Excel v0.6.dyn
# note: REVIT VERSION
# Revit 2014, 2015 and 2016
# note: CREATED BY
# Brendan Cassidy
# note: DYNAMO VERSION
# 1.3.1
# note: DYNAMO SCRIPT PURPOSE
# This script was created to automate the creation of drawing sheets from a excel sheet(drawing register) to revit with the correct BS1192 codes, drawing border size and correct title.
# It has an inbuilt checker to eliminate any sheet numbers that have already been used, this will allow for re-use on a project as it develops through the different design stages were there can be an increase of drawing sheets.
# And an inbuilt checker that will hopefully make sure it is pushing the correct section into the correct section on the drawing borders. EG The role under BS1192 goes into the correct role parameter in revit no matter where this column is on excel sheet.

# group: Code for List checker
list_checker_code = CodeBlock()
# ---------- list_checker_code.designscript (21 lines) ----------
def list_checker(list1:var[], text_input:string)
{
ind = 0;
list2 = {};
c = [Imperative]
{
for ( i in list1)
{
if ( i == text_input)
{
list2[ind] = true;
}
else
{
list2[ind] = false;
}
ind = ind + 1;
}
}
return = list2;
};
# ----------------------------------------

# group: Project Information Section
categories = Categories("ProjectInformation")
all_elements_of_category = ElementsOfCategory(categories)
firstItem = List.FirstItem(all_elements_of_category)

# group: Project BS1192 Revit parameter
project_code_parameter_name = StringInput("ProjectCode")
originator_parameter_name = StringInput("Originator")
discipline_parameter_name = StringInput("Discipline")

# group: UI Input
# note: IMPORTANT NOTE!!
# Prior to the running of this script, you must understand and have read the readme file provided.
codeBlock = CodeBlock()
# ---------- codeBlock.designscript (7 lines) ----------
{"Excel Sheet file:",
"Sheet Tab Name:",
"A0 Title Block:",
"A1 Title Block:",
"A2 Title Block:",
"A3 Title Block:",
"Empty Drafting View:"};
# ----------------------------------------
get_all_title_block_families = Python()  # unwired: IN[0]
# ---------- get_all_title_block_families.python (21 lines) ----------
#Created By Brendan Cassidy

import clr
clr.AddReference('RevitAPI')
from Autodesk.Revit.DB import *

clr.AddReference("RevitServices")
import RevitServices
from RevitServices.Persistence import DocumentManager

doc = DocumentManager.Instance.CurrentDBDocument

collector = FilteredElementCollector(doc)
collector.OfClass(FamilySymbol)
collector.OfCategory(BuiltInCategory.OST_TitleBlocks)

elementlist = list()
for a in collector:
	elementlist.append(a)
	
OUT = elementlist
# ----------------------------------------
get_all_views = Python()  # unwired: IN[0]
# ---------- get_all_views.python (21 lines) ----------
#Created By Brendan Cassidy

import clr
clr.AddReference('RevitAPI')
from Autodesk.Revit.DB import *

clr.AddReference("RevitServices")
import RevitServices
from RevitServices.Persistence import DocumentManager

doc = DocumentManager.Instance.CurrentDBDocument

collector = FilteredElementCollector(doc)
collector.OfCategory(BuiltInCategory.OST_Views)

elementlist = list()
for a in collector:
	if not a.IsTemplate:
		elementlist.append(a)
	
OUT = elementlist
# ----------------------------------------
codeBlock_2 = CodeBlock(a=get_all_title_block_families, b=get_all_views) { {"fp","s",a,a,a,a,b}; }
boolSelector = BoolSelector(true)
download_uk_dynamo_group_image = Python()
# ---------- download_uk_dynamo_group_image.python (44 lines) ----------
#Created By Brendan Cassidy
#https://github.com/brencass/DynamoGraphs

import clr
import sys
sys.path.append("C:\Program Files (x86)\IronPython 2.7\Lib")
import os
from time import sleep

from System.Net import HttpWebRequest,WebRequest,WebResponse
from System.IO import StreamReader
from System.IO import File
from System import IO

clr.AddReference('System.Drawing')
from System.Drawing import Image, Imaging

ImageUrlToDownload="https://raw.githubusercontent.com/brencass/DynamoGraphs/master/ZZZZ-Anything%20Not%20Script%20Related/UKDynamoUserGroup.png"
Path=IO.Path.GetTempPath() + "UKDynamoUserGroup.png"

output=[]


if os.path.exists(Path):
	output.append(Path)
else:
	for a in [ImageUrlToDownload]:
	
		myHttpWebRequest=WebRequest.Create(a)
		myHttpWebRequest.MaximumAutomaticRedirections=5
		myHttpWebRequest.AllowAutoRedirect=True
		myHttpWebRequest.Timeout=120000
		myHttpWebResponse=myHttpWebRequest.GetResponse()
		tempstream=myHttpWebResponse.GetResponseStream()
		
		img = Image.FromStream(tempstream)
	
		img.Save(IO.Path.GetTempPath() + "UKDynamoUserGroup.png", Imaging.ImageFormat.Png)
		
		output.append(Path)

sleep(30)

OUT=output[0]
# ----------------------------------------
python_script = Python(IN[0]=codeBlock, IN[1]=codeBlock_2, IN[2]=boolSelector, IN[3]=download_uk_dynamo_group_image)
# ---------- python_script.python (260 lines) ----------
#Copyright (c) mostafa el ayoubi ,  2016
#Data-Shapes www.data-shapes.net , elayoubi.mostafa@gmail.com

#Error checking and capture added by Brendan Cassidy, Twitter Handle: @Brencass86
#Used to stop the code from saying no module/crashing when not run in a revit instance
#System used is similar to how archi-labs captures errors.

import clr
import sys

import sys
sys.path.append("C:\Program Files (x86)\IronPython 2.7\Lib")

clr.AddReference('System.Windows.Forms')
clr.AddReference('System.Drawing')

from System.Drawing import Point, Image, Size, ContentAlignment, Font, FontStyle
from System.Windows.Forms import Application, Button, Form, Label, TextBox, CheckBox, FolderBrowserDialog, OpenFileDialog, DialogResult, ComboBox, FormBorderStyle, SizeGripStyle, PictureBox, PictureBoxSizeMode, DockStyle
from System.Collections.Generic import *

import os

try:
	errorReport = None
	clr.AddReference('RevitAPIUI')
	from  Autodesk.Revit.UI import Selection

	clr.AddReference('RevitNodes')
	import Revit
	clr.ImportExtensions(Revit.Elements)
	clr.ImportExtensions(Revit.GeometryConversion)

	clr.AddReference('RevitServices')
	from RevitServices.Persistence import DocumentManager
	doc = DocumentManager.Instance.CurrentDBDocument
	uidoc = DocumentManager.Instance.CurrentUIApplication.ActiveUIDocument

	class MultiTextBoxForm(Form):
	
		def __init__(self):
			self.Text = 'Excel to revit Sheet creator'
			self.MinimizeBox= False
			self.MaximizeBox= False
			self.ShowIcon = False
			self.FormBorderStyle = FormBorderStyle.FixedDialog
			self.SizeGripStyle = SizeGripStyle.Hide
			self.output = []
			self.values = []

		def setclose(self, sender, event):
			cbindexread = 0
			for f in self.output:
				if f.GetType() == TextBox:
					self.values.append(f.Text)
				if f.GetType() == CheckBox:
					self.values.append(f.Checked)
				if f.GetType() == Button:
					if f.Tag == None :
						self.values.append(f.Text)
					else:
						self.values.append(f.Tag)
				if f.GetType() == ComboBox:
					self.values.append(globals() ['dict%d'%(cbindexread)][f.Text])
					cbindexread += 1
			self.Close()

		def reset(self, sender, event):
			pass

		def openfile(self, sender, event):
			ofd = OpenFileDialog()
			ofd.Filter = "Excel files (*.xls or .xlsx)|.xls;*.xlsx"
			ofd.InitialDirectory = "::{20D04FE0-3AEA-1069-A2D8-08002B30309D}"
			dr = ofd.ShowDialog()
			if dr == DialogResult.OK:
				sender.Text = ofd.FileName

		def opendirectory(self, sender, event):
			fbd = FolderBrowserDialog()
			fbd.ShowNewFolderButton = False
			dr = fbd.ShowDialog()
			if dr == DialogResult.OK:
				sender.Text = fbd.SelectedPath

		def pickobjects(self, sender, event):
			sel = uidoc.Selection.PickObjects(Selection.ObjectType.Element,'')
			selelem = [doc.GetElement(s.ElementId) for s in sel]
			sender.Tag = (selelem)

		def pickfaces(self, sender, event):
			selface = uidoc.Selection.PickObjects(Selection.ObjectType.Face,'')
			faces = [uidoc.Document.GetElement(s).GetGeometryObjectFromReference(s).ToProtoType(True) for s in selface]
			sender.Tag = [i for f in faces for i in f]

		def pickedges(self, sender, event):
			seledge = uidoc.Selection.PickObjects(Selection.ObjectType.Edge,'')
			edges = [uidoc.Document.GetElement(s).GetGeometryObjectFromReference(s).AsCurve().ToProtoType(True) for s in seledge]
			sender.Tag = edges

		def topmost(self):
			self.TopMost = True
	


	form = MultiTextBoxForm()
	form.topmost()

	xlabel = 25
	xinput = 175
	y = 10
	fields = []
	error = 0
	cbindex = 0
	#Input form

	if isinstance(IN[0],list):
		inputnames = IN[0]
	else:
		inputnames = [IN[0]]

	if isinstance(IN[1],list):
		inputtypes = IN[1]
	else:
		inputtypes = [IN[1]]

	for i,j in zip(inputnames,inputtypes):
		label = Label()
		label.AutoSize = True
		label.Location = Point(xlabel,y+4)
		label.Height = 20
		label.Width = 80
		label.Font = Font("Serif", 8.5, FontStyle.Regular)
		label.Text = str(i)
		form.Controls.Add(label)
		if isinstance(j,list):
			cb = ComboBox()
			cb.Location = Point(xinput,y)
			cb.Width = 150
			globals()['dict%d'%(cbindex)] = {}
			try :
				for k in j:
					globals()['dict%d'%(cbindex)][k.Name] = k
					cb.Items.Add(k.Name)
			except :
				for k in j:
					globals()['dict%d'%(cbindex)][str(k)] = k
					cb.Items.Add(k)
			form.Controls.Add(cb)
			form.output.append(cb)
			cbindex += 1
		elif j == 's':
			tb = TextBox()
			tb.Text = 'Default'
			tb.Width = 150
			tb.Location = Point(xinput,y)
			form.Controls.Add(tb)
			form.Controls.Add(label)
			form.output.append(tb)
		elif j == 'bool':
			yn = CheckBox()
			yn.Location = Point(xinput,y)
			yn.Text = 'Yes/No'
			form.Controls.Add(yn)
			form.output.append(yn)
		elif j == 'fp':
			fp = Button()
			fp.Width = 150
			fp.Text = 'FilePath'
			fp.Location = Point(xinput,y)
			form.Controls.Add(fp)
			fp.Click += form.openfile
			form.output.append(fp)
		elif j == 'dp':
			dp = Button()
			dp.Width = 150
			dp.Text = 'DirectoryPath'
			dp.Location = Point(xinput,y)
			form.Controls.Add(dp)
			dp.Click += form.opendirectory
			form.output.append(dp)
		elif j == 'se':
			se = Button()
			se.Width = 150
			se.Text = 'Select model element(s)'
			se.Location = Point(xinput,y)
			form.Controls.Add(se)
			se.Click += form.pickobjects
			form.output.append(se)
		elif j == 'sf':
			sf = Button()
			sf.Width = 150
			sf.Text = 'Select face(s)'
			sf.Location = Point(xinput,y)
			form.Controls.Add(sf)
			sf.Click += form.pickfaces
			form.output.append(sf)
		elif j == 'sed':
			sed = Button()
			sed.Width = 150
			sed.Text = 'Select Edge(s)'
			sed.Location = Point(xinput,y)
			form.Controls.Add(sed)
			sed.Click += form.pickedges
			form.output.append(sed)

		else :
			error = ["" ,"" ,"" ,"" ,"" ,"" ,"" ,['One or more input types are invalid, visit www.data-shapes.net for more informations']]
		y+= 30

	#Bottom left Image from a inputted image.
	if os.path.isfile(IN[3]):
		pathToFile=IN[3]
		image=Image.FromFile(pathToFile)
		pictureBox = PictureBox()
		pictureBox.Image = image
		pictureBox.Location = Point (15,y+15)
		pictureBox.Size = Size(125, 30)
		pictureBox.SizeMode = PictureBoxSizeMode.Zoom
		form.Controls.Add(pictureBox)
	
	button = Button()
	button.Text = 'Run Script'
	button.Width = 100
	button.Location = Point (225,y+15)
	button.Click += form.setclose
	form.Controls.Add(button)
		
	Dis_Font = Font("Arial", 7, FontStyle.Regular)
	
	Dis_Label = Label()
	Dis_Label.AutoSize = False
	Dis_Label.Height = 50
	Dis_Label.Width = 325
	Dis_Label.Location = Point(0,y+40)
	Dis_Label.TextAlign = ContentAlignment.BottomRight
	Dis_Label.Text = "© Origanal UI code by Mostafa El Ayoubi(@data_shapes). Styles added and code modified for this script by Brendan Cassidy(@brencass86)."
	Dis_Label.Font = Dis_Font
	form.Controls.Add(Dis_Label)
		
	form.Height = y + 150
	form.Width = 365
		
except:
	# if error accurs anywhere in the process catch it
	import traceback
	errorReport = traceback.format_exc()


if errorReport == None:
	if error == 0:
		Application.Run(form)
		if len(form.values) != len(set(form.values)):
			OUT = ["" ,"" ,"" ,"" ,"" ,"" ,"" ,["Two or more values for UI match. No values should match"]]
		else:
			OUT  = [form.values,"Completed"]

	else :
		OUT  = error
else:
	OUT=["" ,"" ,"" ,"" ,"" ,"" ,"" ,["This UI Form generator has been built \nwith revit functionality within.\nTherefore it will only run once it is \npart of a revit instance (Dynamo launched \nfrom within revit ribbon)"]]
# ----------------------------------------

codeBlock_3 = CodeBlock(a=python_script) { a[0][0]; a[0][1]; }
fromPath = FileObject(codeBlock_3.out0)  # "File.FromPath"
readFromFile = Excel.ReadFromFile(file=fromPath, sheetName=codeBlock_3.out1)

# group: Excel Row Removal
this_removes_first_few_rows = DoubleInput(5)

# group: List Trimmer
code_block = CodeBlock(lst=readFromFile, x1=this_removes_first_few_rows) { List.Transpose(List.Slice(lst,x1,List.Count(lst),1)); }

# group: Project BS1192 Excel Column Names
excel_column_name_for_project = StringInput("Project Prefix")  # "Excel column name for Project Code"
excel_column_for_organisation = StringInput("Organisation Code")  # "Excel column for Organisation Code"
excel_column_for_profession_code = StringInput("Profession Code")

# group: Project Information Checker Section
code_block_2 = CodeBlock(lst3=code_block, lst=readFromFile, code=excel_column_name_for_project) { List.GetItemAtIndex(List.Flatten(List.GetItemAtIndex(lst3, List.FilterByBoolMask(GetKeys(lst3), list_checker(lst[3], code))["in"]),1),0); }
setParameterByName = Element.SetParameterByName(element=firstItem, parameterName=project_code_parameter_name, value=code_block_2)
code_block_3 = CodeBlock(lst3=code_block, lst=readFromFile, code=excel_column_for_organisation) { List.GetItemAtIndex(List.Flatten(List.GetItemAtIndex(lst3, List.FilterByBoolMask(GetKeys(lst3), list_checker(lst[3], code))["in"]),1),0); }
setParameterByName_2 = Element.SetParameterByName(element=firstItem, parameterName=originator_parameter_name, value=code_block_3)
code_block_4 = CodeBlock(lst3=code_block, lst=readFromFile, code=excel_column_for_profession_code) { List.GetItemAtIndex(List.Flatten(List.GetItemAtIndex(lst3, List.FilterByBoolMask(GetKeys(lst3), list_checker(lst[3], code))["in"]),1),0); }
setParameterByName_3 = Element.SetParameterByName(element=firstItem, parameterName=discipline_parameter_name, value=code_block_4)

# group: Drawing Sheet BS1192 Excel Column Names
excel_column_name_for_unique = StringInput("Sequence Number")  # "Excel column name for unique number"
excel_column_name_for = StringInput("Classification")  # "Excel column name for Classification"
excel_column_name_for_drawing = StringInput("Drawing Type")  # "Excel column name for Drawing type"
excel_column_name_for_drawing_2 = StringInput("Zone")  # "Excel column name for drawing Zone"
excel_column_name_for_floor = StringInput("Floor Level")  # "Excel column name for floor level"
excel_column_name_for_drawing_3 = StringInput("Drawing Name")  # "Excel column name for drawing title"
excel_column_name_for_drawing_4 = StringInput("Size")  # "Excel column name for Drawing size"

# group: Sheet Information Checker Section
code_block_5 = CodeBlock(lst3=code_block, lst=readFromFile, code=excel_column_name_for_unique) { List.Flatten(List.GetItemAtIndex(lst3, List.FilterByBoolMask(GetKeys(lst3), list_checker(lst[3], code))["in"]),1); }
code_block_6 = CodeBlock(lst3=code_block, lst=readFromFile, code=excel_column_name_for) { List.Flatten(List.GetItemAtIndex(lst3, List.FilterByBoolMask(GetKeys(lst3), list_checker(lst[3], code))["in"]),1); }
code_block_7 = CodeBlock(lst3=code_block, lst=readFromFile, code=excel_column_name_for_drawing) { List.Flatten(List.GetItemAtIndex(lst3, List.FilterByBoolMask(GetKeys(lst3), list_checker(lst[3], code))["in"]),1); }
code_block_8 = CodeBlock(lst3=code_block, lst=readFromFile, code=excel_column_name_for_drawing_2) { List.Flatten(List.GetItemAtIndex(lst3, List.FilterByBoolMask(GetKeys(lst3), list_checker(lst[3], code))["in"]),1); }
code_block_9 = CodeBlock(lst3=code_block, lst=readFromFile, code=excel_column_name_for_floor) { List.Flatten(List.GetItemAtIndex(lst3, List.FilterByBoolMask(GetKeys(lst3), list_checker(lst[3], code))["in"]),1); }
code_block_10 = CodeBlock(lst3=code_block, lst=readFromFile, code=excel_column_name_for_drawing_3) { List.Flatten(List.GetItemAtIndex(lst3, List.FilterByBoolMask(GetKeys(lst3), list_checker(lst[3], code))["in"]),1); }
code_block_11 = CodeBlock(lst3=code_block, lst=readFromFile, code=excel_column_name_for_drawing_4) { List.Flatten(List.GetItemAtIndex(lst3, List.FilterByBoolMask(GetKeys(lst3), list_checker(lst[3], code))["in"]),1); }

# group: Drawing Size's for filter
code_block_12 = CodeBlock()
# ---------- code_block_12.designscript (6 lines) ----------
//Drawing size checks

"A0";
"A1";
"A2";
"A3";
# ----------------------------------------

codeBlock_4 = CodeBlock(a=python_script) { a[0][2]; a[0][3]; a[0][4]; a[0][5]; }

# group: Sheet Border adder
python_script_2 = Python(IN[0]=code_block_11, IN[1]=code_block_12.out0, IN[2]=code_block_12.out1, IN[3]=code_block_12.out2, IN[4]=code_block_12.out3, IN[5]=codeBlock_4.out0, IN[6]=codeBlock_4.out1, IN[7]=codeBlock_4.out2, IN[8]=codeBlock_4.out3)
# ---------- python_script_2.python (31 lines) ----------
import clr
clr.AddReference('ProtoGeometry')
from Autodesk.DesignScript.Geometry import *
#The inputs to this node will be stored as a list in the IN variables.

List_Check=IN[0]

Size_A0=IN[1]
Size_A1=IN[2]
Size_A2=IN[3]
Size_A3=IN[4]

Family_A0=IN[5]
Family_A1=IN[6]
Family_A2=IN[7]
Family_A3=IN[8]

output=[]

for a in List_Check:
	if a == Size_A0:
		output.append(Family_A0)
	elif a == Size_A1:
		output.append(Family_A1)
	elif a == Size_A2:
		output.append(Family_A2)
	elif a == Size_A3:
		output.append(Family_A3)

#Assign your output to the OUT variable.
OUT = output
# ----------------------------------------

# group: Sheet Category
categories_2 = Categories("Sheets")
all_elements_of_category_2 = ElementsOfCategory(categories_2)
sheetNumber = Sheet.SheetNumber(all_elements_of_category_2)

# group: List Re-organiser, Trimmer And Null Checker
code_block_13 = CodeBlock(a=code_block_5, b=code_block_6, c=code_block_7, d=code_block_8, e=code_block_9, f=code_block_10, g=code_block_11, h=python_script_2, Sheetnumber=sheetNumber) { lst4 = List.FilterByBoolMask(List.Transpose({a,b,c,d,e,f,g,h}),List.ContainsItem(Sheetnumber,a))["out"]; }
python_script_3 = Python(IN[0]=code_block_13)
# ---------- python_script_3.python (75 lines) ----------
#Created By Brendan Cassidy

#Libraries
import clr
clr.AddReference('ProtoGeometry')
from Autodesk.DesignScript.Geometry import *

clr.AddReference('DSCoreNodes')
import DSCore
from DSCore import *

clr.AddReference('Display')
import Display
from Display import *


#Input
lst=IN[0]

#Counts total number of null elements
if lst:
	temp_output=[]
	for a in lst:
		temp_count=0
		for b in a:
			if not b:
				temp_count=(temp_count+1)
		temp_output.append(temp_count)

	#Counts total elements in sublist
	Total=len(lst[0])

	#counts partial null values and
	#outputs content with zero null values
	null_count=0
	output=[]

	count=0
	for a in lst:
		if 0 < temp_output[count] < Total:
 	 		count=(count+1)
 	 		null_count=(null_count+1)
		elif temp_output[count] == 0:
			count=(count+1)
 			output.append(a)
 		else:
 			count=(count+1)


	#Warning text output
	if len(output) > 0:
		if null_count == 0:
			Output_text="There were no drawings from the \nexcel sheet that had some elements as \nnull values. Therefore all drawings \nsheets that was not already in revit\nhave been created in revit."
			Output_Color=Color.ByARGB(255, 0, 250, 050)
		else:
			Output_text="There are " + str(null_count) + " total drawings from the \nexcel sheet that have some null \nelements within. Therefore you will \nneed to sort these prior to them \nbeing created in revit."
			Output_Color=Color.ByARGB(255, 250, 130, 050)
	else:
		Output_text="There are no drawing sheets to process"
		Output_Color=Color.ByARGB(255, 250, 0, 0)
else:
	Output_text="There are no drawing sheets to process"
	Output_Color=Color.ByARGB(255, 250, 0, 0)
	output=[]

#Cubiod indicator
So=Cuboid.ByLengths(10,10,10)
Eo=So.Edges
Offset=1
Output_Solid=Solid.Fillet(So,Eo,Offset)

OSC=Display.ByGeometryColor(Output_Solid,Output_Color)

#Output
OUT=[output,Output_text,OSC]
# ----------------------------------------
code_block_14 = CodeBlock(a=python_script_3) { a[1]; a[0]; }

# group: Error Indicator
watch = Watch(code_block_14.out0)

codeBlock_5 = CodeBlock(a=python_script) { a[0][6]; }

# group: Revit BS1192 Sheet Parameter
drawing_type_parameter_name = StringInput("Drawing Type")
zone_parameter_name = StringInput("Zone")
sheet_size_parameter_name = StringInput("Sheet Size")
floor_level_parameter_name = StringInput("Floor Level")
# note: BS1192 Revit parameters
classification_parameter_name = StringInput("Classification")

# group: Sheet Creator
transpose = List.Transpose(code_block_14.out1)
create_independant_lists = CodeBlock(list=transpose) { list[0]; list[1]; list[2]; list[3]; list[4]; list[5]; list[6]; list[7]; }
byNameNumberTitleBlockAndView = Sheet.ByNameNumberTitleBlockAndView(sheetName=create_independant_lists.out5, sheetNumber=create_independant_lists.out0, titleBlockFamilyType=create_independant_lists.out7, view=codeBlock_5)
setParameterByName_4 = Element.SetParameterByName(element=byNameNumberTitleBlockAndView, parameterName=drawing_type_parameter_name, value=create_independant_lists.out2)
setParameterByName_5 = Element.SetParameterByName(element=byNameNumberTitleBlockAndView, parameterName=zone_parameter_name, value=create_independant_lists.out3)
setParameterByName_6 = Element.SetParameterByName(element=byNameNumberTitleBlockAndView, parameterName=sheet_size_parameter_name, value=create_independant_lists.out6)
setParameterByName_7 = Element.SetParameterByName(element=byNameNumberTitleBlockAndView, parameterName=floor_level_parameter_name, value=create_independant_lists.out4)
count = List.Count(create_independant_lists.out5)
setParameterByName_8 = Element.SetParameterByName(element=byNameNumberTitleBlockAndView, parameterName=classification_parameter_name, value=create_independant_lists.out1)
count_2 = List.Count(setParameterByName_8)
code_block_15 = CodeBlock(a=count, b=count_2) { a==b; }

codeBlock_6 = CodeBlock(a=python_script, b=download_uk_dynamo_group_image) { {a[1],b}; }
codeBlock_7 = CodeBlock(a=codeBlock_6) { a[0]; a[1]; }
codeBlock_8 = CodeBlock(a=code_block_14.out0) { a; }
codeBlock_9 = CodeBlock(a=codeBlock_8) { a; }
python_script_4 = Python(IN[0]=codeBlock_7.out0, IN[1]=codeBlock_9, IN[2]=codeBlock_7.out1, IN[3]=code_block_15)
# ---------- python_script_4.python (154 lines) ----------
#Copyright (c) mostafa el ayoubi ,  2016
#Data-Shapes www.data-shapes.net , elayoubi.mostafa@gmail.com

#Code trimmed to relevant parts. Error checking and capture added by Brendan Cassidy, Twitter Handle: @Brencass86
#Used to stop the code from saying no module/crashing when not run in a revit instance
#System used is similar to how archi-labs captures errors.

import clr
import sys

import sys
sys.path.append("C:\Program Files (x86)\IronPython 2.7\Lib")

clr.AddReference('System.Windows.Forms')
clr.AddReference('System.Drawing')

from System.Drawing import Point, Image, Size, ContentAlignment, Font, FontStyle
from System.Windows.Forms import Application, Button, Form, Label, FormBorderStyle, SizeGripStyle, PictureBox, PictureBoxSizeMode, DockStyle
from System.Collections.Generic import *

import os

try:
	errorReport = None
	clr.AddReference('RevitAPIUI')
	from  Autodesk.Revit.UI import Selection

	clr.AddReference('RevitNodes')
	import Revit
	clr.ImportExtensions(Revit.Elements)
	clr.ImportExtensions(Revit.GeometryConversion)

	clr.AddReference('RevitServices')
	from RevitServices.Persistence import DocumentManager
	doc = DocumentManager.Instance.CurrentDBDocument
	uidoc = DocumentManager.Instance.CurrentUIApplication.ActiveUIDocument

	class MultiTextBoxForm(Form):
	

		def __init__(self):
			self.Text = 'Excel to revit Sheet Report'
			self.MinimizeBox= False
			self.MaximizeBox= False
			self.ShowIcon = False
			self.FormBorderStyle = FormBorderStyle.FixedDialog
			self.SizeGripStyle = SizeGripStyle.Hide
			self.output = []
			self.values = []

		def setclose(self, sender, event):
			self.Close()

		def reset(self, sender, event):
			pass

		def topmost(self):
			self.TopMost = True
	if IN[3]:
		form = MultiTextBoxForm()
		form.topmost()

		xlabel = 25
		xinput = 175
		y = 10
		fields = []
		error = 0
		cbindex = 0
		
		
		#Error types
		Error1="There were no drawings from the excel sheet that had some elements as null values. Therefore all drawings sheets that was not already in revit have been created in revit."
		Error2="There are no drawing sheets to process."
		Error3="There were no drawings from the excel sheet that had some elements as null values. Therefore all drawings sheets that was not already in revit have been created in revit."
		Error4="This UI Form generator has been built with revit functionality within.Therefore it will only run once it is part of a revit instance (Dynamo launched from within revit ribbon)"
		Error5="Two or more values for UI match. No values should match"
			
		if IN[0] == "Completed":
			if IN[1] == Error1:
				Text_Height=70
			elif IN[1] == Error2:
				Text_Height=20
			elif IN[1] == Error3:
				Text_Height=70
			else:
				Text_Height=70
			output_text=IN[1]
		else:
			if IN[0] == Error4:
				Text_Height=70
			elif IN[0] == Error5:
				Text_Height=50
			else:
				Text_Height=70
			output_text=IN[0]
			
		
		label = Label()
		label.AutoSize = False
		label.Location = Point(xlabel,y+4)
		label.Height = Text_Height
		label.Width = 315
		label.Font = Font("Serif", 10, FontStyle.Regular)
		label.Text = str(output_text)
		form.Controls.Add(label)

		#Bottom left Image from a inputted image.
		if os.path.isfile(IN[2]):
			pathToFile=IN[2]
			image=Image.FromFile(pathToFile)
			pictureBox = PictureBox()
			pictureBox.Image = image
			pictureBox.Location = Point (15,y+Text_Height+15)
			pictureBox.Size = Size(125, 30)
			pictureBox.SizeMode = PictureBoxSizeMode.Zoom
			form.Controls.Add(pictureBox)
		
		button = Button()
		button.Text = 'Ok'
		button.Width = 100
		button.Location = Point (225,y+Text_Height+15)
		button.Click += form.setclose
		form.Controls.Add(button)
			
		Dis_Font = Font("Arial", 7, FontStyle.Regular)
		
		Dis_Label = Label()
		Dis_Label.AutoSize = False
		Dis_Label.Height = 50
		Dis_Label.Width = 320
		Dis_Label.Location = Point(0,y+Text_Height+40)
		Dis_Label.TextAlign = ContentAlignment.BottomRight
		Dis_Label.Text = "© Origanal UI code by Mostafa El Ayoubi(@data_shapes). Styles added and code modified for this script by Brendan Cassidy(@brencass86)."
		Dis_Label.Font = Dis_Font
		form.Controls.Add(Dis_Label)
			
		form.Height = y + Text_Height + 150
		form.Width = 365
			
		
except:
	# if error accurs anywhere in the process catch it
	import traceback
	errorReport = traceback.format_exc()

if errorReport == None:
	if error == 0:
		Application.Run(form)
		OUT  = output_text

	else :
		OUT  = error
else:
	OUT=errorReport
# ----------------------------------------
