# Dynamo graph Automatic Dynamo Package downloader.dyn (Dynamo 1.3.2.2480)

# group: Dynamo Script Information
# note: DYNAMO SCRIPT PURPOSE
# This script will download a set of given packages from a excel file from the dynamo website. Then it will extract their contents into a central location.
# It will DELETE any content that matches the details in the excel file.
# note: REVIT VERSION
# N/A
# note: DYNAMO VERSION
# 1.3.2
# note: CREATED BY
# Brendan Cassidy
# note: DYNAMO FILE REVISION AND STATUS
# Revision P01
# note: DYNAMO FILE NAME
# Automatic Dynamo Package Downloader.dyn

# group: Input
excel_file = Filename(".\Authorised packages.xlsx")
sheet_name = StringInput("Sheet1")

# group: Read Excel File
fromPath = FileObject(excel_file)  # "File.FromPath"
readFromFile = Excel.ReadFromFile(file=fromPath, sheetName=sheet_name)
code_block = CodeBlock(Exceldata=readFromFile)
# ---------- code_block.designscript (8 lines) ----------
//Server Location
Exceldata[2][1];

//Temp Location
Exceldata[3][1];

//Data
Exceldata[(5..(List.Count(Exceldata)-1))];
# ----------------------------------------

download_latest_package_files = Python(IN[0]=code_block.out0, IN[1]=code_block.out1, IN[2]=code_block.out2)
# ---------- download_latest_package_files.python (36 lines) ----------
#Created By Brendan Cassidy
#https://github.com/brencass/DynamoGraphs

from System.Net import HttpWebRequest,WebRequest,WebResponse
from System.IO import StreamReader
from System.IO import File

import clr
import sys
sys.path.append("C:\Program Files (x86)\IronPython 2.7\Lib")
import os
from time import sleep

output=[]
for a in IN[2]:
	if a[0] is not None:
		myHttpWebRequest=WebRequest.Create(a[1])
		myHttpWebRequest.MaximumAutomaticRedirections=5
		myHttpWebRequest.AllowAutoRedirect=True
		myHttpWebRequest.Timeout=120000
		myHttpWebResponse=myHttpWebRequest.GetResponse()
		tempstream=myHttpWebResponse.GetResponseStream()


		Path=IN[1] + a[0] + ".zip"
	
		if os.path.isfile(Path):
			os.remove(Path)
	
		fileCreate= File.Create(Path)
		tempstream.CopyTo(fileCreate)
		output.append([Path,a[0]])

sleep(30)

OUT=[IN[0],output]
# ----------------------------------------
unzip_downloaded_files = Python(IN[0]=download_latest_package_files)
# ---------- unzip_downloaded_files.python (28 lines) ----------
#Created By Brendan Cassidy
#https://github.com/brencass/DynamoGraphs

import clr
import sys
sys.path.append("C:\Program Files (x86)\IronPython 2.7\Lib")

import zipfile
import os
import shutil
from time import sleep

sleep(30)

output=[]
for a in IN[0][1]:
	ExtractPath=IN[0][0] + a[1]
	
	
	if os.path.isdir(ExtractPath):
		shutil.rmtree(ExtractPath)
		
	zip_ref = zipfile.ZipFile(a[0], 'r')
	zip_ref.extractall(ExtractPath)
	zip_ref.close()
	output.append(a[1])

OUT=output
# ----------------------------------------

# group: Output
watch = Watch(unzip_downloaded_files)
