# Dynamo graph Get Folder Structure(Certain File Types Only).dyn (Dynamo 1.3.2.2480)

# group: Dynamo Script Information
# note: DYNAMO FILE NAME
# Get Folder Structure.dyn
# note: DYNAMO VERSION
# 1.2.1
# note: CREATED BY
# Brendan Cassidy
# note: DYNAMO SCRIPT PURPOSE
# This script will walk through a folder starting at the given directory then output the sub-folders and files into a output structure if they contain a given file type.
# note: REVIT VERSION
# N/A
# note: DYNAMO FILE REVISION AND STATUS
# Status: S?
# Revision P01

# group: Input
# note: If you do not have a excel file just type <New Name>.xls within the open file dialog. This will generate a new excel file with the information once it has been run
file_path_to_excel_file = Filename("..\..\..\..\..\temp\output.xlsx")
workbook_name = StringInput("Sheet1")
offset_to_start_inputting_data = DoubleInput(1)  # "Offset to start inputting Data to Excel."
directory_that_is_to_be_searched = Directory("C:\temp")

file_types = StringInput(".rfa")

# group: Generates Folder Structure
generates_folder_structure = Python(IN[0]=directory_that_is_to_be_searched, IN[1]=file_types)
# ---------- generates_folder_structure.python (48 lines) ----------
#Created By Brendan Cassidy

import clr

#Sets up new path to ironpython module Library
#See https://docs.python.org/2/library/sys.html
import sys
sys.path.append("C:\Program Files (x86)\IronPython 2.7\Lib")

#Imports date/time info
#See https://docs.python.org/2/library/time.html
from time import gmtime, strftime
#Applying time Day-Month-Year at Hour:min
time_info="Run on " + strftime("%d %b %Y at %H:%M", gmtime())

#Imports math
#See https://docs.python.org/2/library/math.html
import math

#Converts File Size to highest it can go to in relation to byte size
#eg 59,158,528 bytes converts to 56.42 MB.
def convertSize(size):
   size_name = ("B", "KB", "MB", "GB", "TB", "PB", "EB", "ZB", "YB")
   i = int(math.floor(math.log(size,1024)))
   p = math.pow(1024,i)
   s = round(size/p,2)
   if (s > 0):
       return '%s %s' % (s,size_name[i])
   else:
       return '0B'

#Imports operating system interfaces
#See https://docs.python.org/2/library/os.html
import os

#Gets all subdirectories and files from a inputted directory
output=[time_info]
for root, dirs, files in os.walk(IN[0]):
	level = root.replace(IN[0], '').count(os.sep)
	indent = ' ' * 4 * (level)
	output.append('{}{}/'.format(indent, os.path.basename(root)))
	subindent = ' ' * 4 * (level + 1)
	for f in files:
		if IN[1] in f:
			output.append('{}{}'.format(subindent, f))

#Output
OUT= output
# ----------------------------------------

overwrite = BoolSelector(false)

# group: Writes to Excel File
writeToFile = Excel.WriteToFile(filePath=file_path_to_excel_file, sheetName=workbook_name, startRow=offset_to_start_inputting_data, startCol=offset_to_start_inputting_data, data=generates_folder_structure, overWrite=overwrite)
